# Grasshopper definition 01_amuseBouche.ghx (Grasshopper 0.9.75)
# plug-ins: Decodes Python Interpreter

# A Scrap of Control Flow
number_slider = Slider(5, range=0..10)
number_slider_2 = Slider(-6, range=-20..10)  # disabled
number_slider_3 = Slider(16, range=0..50)  # disabled
number_slider_4 = Slider(23, range=0..50)  # disabled
# line segment
# color and line weight
decodes = DecodesPythonScript(r=Slider(0.8, range=0..1), g=Slider(0.5, range=0..1), b=Slider(0.5, range=0..1), ln_weight=number_slider)  # -> console, a, a_props
# ---------- decodes: Python ----------
#To see the color and line weight, pull down a "hard-boil" box, right-click on the
#decodes and check "Display Output Properties" and hook up two wires


pt_a = Point()
vec_a = Vec(10,10,10)
ln_a = Segment(pt_a, vec_a)
ln_a.set_color(r,g,b)
ln_a.set_weight(ln_weight)


a.put(ln_a)
# ---------- end decodes ----------
# AMUSE-BOUCHE TO SCRIPTING IN DECODES
decodes_2 = DecodesPythonScript()  # -> console, a
# ---------- decodes_2: Python ----------
print range(3)

print range(4)

import math
# from math import sin, cos
# from math import *
print math.sin(0), "is smaller than", math.cos(0)
# ---------- end decodes_2 ----------
# using libraries of functions
# A Bit of Geometry
decodes_3 = DecodesPythonScript()  # -> console, a, b
# ---------- decodes_3: Python ----------
# point construction
pt_a = Point(2,3)
pt_b = Point(10,20,30)
print pt_a
print pt_b

#dot operator accesses methods
print pt_a.x, pt_a.y, pt_a.z
print pt_a.distance(pt_b)

# point manipulation
pt_a.x = 3
print pt_a



a.put(pt_a)
b.put(pt_b)
# ---------- end decodes_3 ----------
# vector
decodes_4 = DecodesPythonScript(t=Slider(0.291, range=0..1))  # -> console, a, b
# ---------- decodes_4: Python ----------
# segment construction
#  by point-vec
pt_a = Point(-2,5,0)
ln_a = Segment(pt_a, Vec(2,1,0))
#  by 2 points
pt_b = Point(5,-10,10)
ln_b = Segment(pt_a, pt_b)

print "segment start point is", ln_b.spt
print "segment end point is", ln_b.ept
#note spt and ept are methods for all linear entities but methods like 
#inverted (reverses direction), midpoint and length only apply to a segment
ln_b = ln_b.inverted()
print "segment start point is", ln_b.spt
print "segment end point is", ln_b.ept
print "segment midpoint is", ln_b.midpoint
print "segment length is ", ln_b.length
pt_at_t = ln_b.eval(t)


a.put(ln_b)
b.put(pt_at_t)
# ---------- end decodes_4 ----------
# point
decodes_5 = DecodesPythonScript()  # -> console, a, b
# ---------- decodes_5: Python ----------
# vector construction 
pt_a = Point()
pt_b = Point(-2,4,5)
vec_a = Vec(0,2, 0)
vec_b = Vec(pt_a,pt_b)

print vec_b.length

a.put(pt_a)
b.put(vec_a)
b.put(vec_b)

# point – vector interaction
pt_c = Point(2,3,-1)
pt_d = pt_c + vec_a
print pt_d
# ---------- end decodes_5 ----------
# conditionals
# loops
decodes_6 = DecodesPythonScript()  # -> console, a
# ---------- decodes_6: Python ----------
count = 3
for n in range(count):
    print "n is equal to", n
    
    
for dictum in ["more." , "a bore."]:
    print "Less is", dictum
    
#a geometric example
count = 5

pts = [Point(n, 2*n) for n in range(-count, count)]
#this is shorthand for the following code block
"""
pts = []
for n in range(-count, count):
    pts.append(Point(n, 2*n))
"""
    
a.put(pts)
# ---------- end decodes_6 ----------
# plane
# 3b
pt = Point(Point(9, 21, 6))  # disabled
decodes_7 = DecodesPythonScript()  # -> console, a
# ---------- decodes_7: Python ----------
do_it = True
if do_it:
    print "it's done."
    
    
if 1+1 > 2:
    print "Albers was right!"
else:
    print "Albers was wrong!"
    
#a geometric example
vec_a = Vec(1,0,0)
vec_b = Vec(2,1,3)
if vec_a.dot(vec_b) == 0:
    print "Vectors are perpendicular"
else:
    print "Vectors aren't perpendicular"
# ---------- end decodes_7 ----------
panel = Panel(decodes_3.console)
panel_2 = Panel(decodes_6.console)
# functions
decodes_8 = DecodesPythonScript()  # -> console, a, b; disabled
# ---------- decodes_8: Python ----------
#A circle in the 2D plane

center = Point(1,2)
radius = 5

circ_0 = Circle(Plane(center, Vec(0,0,1)), radius)

a.put(circ_0)

#A circle lying in an arbitrary plane
circ_1 = Circle(Plane(center, Vec(1,3,-2)), radius)

b.put(circ_1)
# ---------- end decodes_8 ----------
# circle
# interval
decodes_9 = DecodesPythonScript(a=number_slider_2, b=number_slider_3, cnt=number_slider_4)  # -> console, out; inputs a: Int32, b: Int32, cnt: Int32; disabled
# ---------- decodes_9: Python ----------
#Visualizing what the Interval class does by drawing points in 1 dimension
#Note: by convention, a general interval is often defined as (a,b).  If you use
#this convention, make sure that whatever output geometry that you have doesn't 
#have the same name


ival = Interval(a, b)

#eval takes input parameter from 0 to 1 and outputs the value in interval corresponding to the parameter 
print ival.eval(0) #start point, a
print ival.eval(0.5) #midpoint, 0.5*(b-a)
print ival.eval(1)   #endpoint, b

print ival.divide(cnt) #this outputs a list of numbers uniformly dividing the interval into cnt 
print ival/cnt         #this is shorthand for the same thing

print ival.divide(cnt, True) #this includes the endpoint of the interval

pts = [Point(t, 0) for t in ival/cnt]
#this is shorthand for the following code block
"""
pts = []
for t in ival/cnt:
    pts.append(Point(t,0))
""" 




out.put(pts)
# ---------- end decodes_9 ----------
# transformations (Xform)
decodes_10 = DecodesPythonScript(pt=pt)  # -> console, out; disabled
# ---------- decodes_10: Python ----------
#Plane construction

vec_pt = Point(pt, Point())
pln_vec = vec_pt.cross(Vec(0,0,1))
n_vec = pln_vec.cross(Vec(pt))

out.put(Plane(pt, n_vec))
# ---------- end decodes_10 ----------
panel_3 = Panel(decodes_2.console)
decodes_11 = DecodesPythonScript()  # -> console, a, b, c, d; disabled
# ---------- decodes_11: Python ----------
#Plane transformations

def square_1():
    center = Point()
    return PGon.rectangle(center, 1, 1)

a.put(square_1())

square = square_1()
#rotation takes an angle in radians so first import math
from math import radians
xf_rot = Xform.rotation(axis = Vec(0,0,1), angle = radians(60))
b.put(square*xf_rot)

#notice that square has changed to be the rotated square so reset it to square 1 
square = square_1()
xf_move = Xform.translation(Vec(1,1,1))
c.put(square*xf_move)

square = square_1()
xf_scale = Xform.scale(1.5)
d.put(square*xf_scale)
# ---------- end decodes_11 ----------
# further down the road ...
decodes_12 = DecodesPythonScript()  # -> console; disabled
# ---------- decodes_12: Python ----------
def say_hi():
    print "hi"

say_hi()


def print_problems(problem_count):
    print "i've got "+str(problem_count)+" problems"
    
print_problems(99)



venturi_published = 1966

def less(year):
    # venturi_published = 1905
    # venturi_published += 1905
    if year > venturi_published: return "a bore."
    else : return "more."

print "complex and contra published in", venturi_published
print "less is", less(1955)
# ---------- end decodes_12 ----------
panel_4 = Panel(decodes_7.console)
vdis = VectorDisplay(Anchor=decodes_5.a, Vector=decodes_5.b)
panel_5 = Panel(decodes_5.console)
# To see the color and line weight, pull down a "hard-boil" box (above the decodes box), right-click on the
# decodes and check "Display Output Properties" and hook up two wires
hardboil = DecodesHardBoil(Geometry=decodes.a, Properties=decodes.a_props)
