# Grasshopper definition 02_attractors.ghx (Grasshopper 0.9.75)
# plug-ins: Decodes Python Interpreter

md_slider = MDSlider(
    slider_value=Point(0.7498087069, 0.3802192502, 0.5),
    SliderMode=0,
    x_domain=Domain(0, 13),
    y_domain=Domain(0, 13),
    z_domain=Domain(0, 1))
number_slider = Slider(10, range=0..10)

# ---- group: A Simple Attractor Script
number_slider_2 = Slider(10, range=1..10)
md_slider_2 = MDSlider(
    slider_value=Point(0.6488055718, 0.2413456614, 0.5),
    SliderMode=0,
    x_domain=Domain(2, 8),
    y_domain=Domain(2, 8),
    z_domain=Domain(0, 1))
trigrid = Triangular(Plane=PlaneXY(0, 0, 0), Size=1, ExtentX=expr("x*2", number_slider_2), ExtentY=number_slider_2)  # -> Cells, Points
pt = Point(md_slider_2)
# c
cp = ControlPoints(Curve=trigrid.Cells)  # -> Points, Weights, Knots
decodes = DecodesPythonScript(pts=cp.Points, attr_pt=pt, power=Slider(0.3, range=0..1), max_dist=Slider(0.73, range=0..1))  # -> console, outie; inputs pts: list, attr_pt: Point3d
# ---------- decodes: Python ----------
"""
Each line of code in the loop below will execute once per point we have been given. For each cycle of the loop, we may refer to a variable 'pt' that refers to a single point from the given list. In each cycle, we calculate the distance and direction to move our point, and then create a new point in this position. since "adding" a vector to a point will move that point, we may use the addition operator (+) for this purpose, by adding a resized version of the vector we created earlier to pt. The newly created Point is then "put" in an outie so that we may see it on-screen.
"""

# iterate through each point in the given list of points using a loop
for pt in pts: 
    # first, create a vector from 'pt' to the attractor point
    vec = Vec(pt,attr_pt)
    
    #vector length is greater than zero
    if vec.length > 0:
        # next, calculate the distance to move 'pt'
        dist = min(vec.length*max_dist,vec.length**power)
    
        # create a new point in the desired position
        new_pt = pt + vec.normalized(dist)
        # put this new point in our outie
        outie.put(new_pt)
# ---------- end decodes ----------
unflatten = UnflattenTree(Tree=decodes.outie, Guide=cp.Points)
pline = PolyLine(Vertices=unflatten, Closed=False)

# ----
number_slider_3 = Slider(9, range=0..10)

# ---- group: Other (2D) Grids
trigrid_2 = Triangular(Plane=PlaneXY(0, 0, 0), Size=1, ExtentX=expr("x*2", number_slider), ExtentY=number_slider)  # -> Cells, Points
hexgrid = Hexagonal(Plane=PlaneXY(0, 0, 0), Size=1, ExtentX=number_slider_3, ExtentY=number_slider_3)  # -> Cells, Points
pt_2 = Point(flatten(hexgrid.Points))
pt_3 = Point(flatten(trigrid_2.Points))

# ---- group: (2D) grid
# a
decodes_2 = DecodesPythonScript()  # -> console, a
# ---------- decodes_2: Python ----------
#A 2D grid of points on a square canvas

length_canvas = 14
count_x = 10  #number of grid points in the horizontal "x" direction
count_y = 12  #number of grid points in the vertical "y" direction

pts = []

for i in range(count_x):
    for j in range(count_y):
        pt_grid = Point(i*length_canvas/count_x, j*length_canvas/count_y)
        pts.append(pt_grid)
    
a.put(pts)
# ---------- end decodes_2 ----------
pt_4 = Point(flatten(decodes_2.a))

# ----
pt_5 = Point(md_slider)

# ---- group: Frame Field
# b
decodes_3 = DecodesPythonScript(attr_pt=pt_5, pts=pt_4)  # -> console, a, b; inputs pts: list
# ---------- decodes_3: Python ----------
#This script generates a set of perpendicular lines at each input grid point with 
#orientation dependent on an attractor point

x_ray, y_ray = [],[]
for pt in pts:
    vec_x = Vec(pt,attr_pt).normalized(0.6)
    vec_y = vec_x.cross(Vec(0,0,1)).normalized(0.6)
    
    x_ray.append(Segment(pt,vec_x))
    y_ray.append(Segment(pt,vec_y))
    
a.put(x_ray)
b.put(y_ray)
# ---------- end decodes_3 ----------
geo = Geometry(decodes_3.a)
geo_2 = Geometry(decodes_3.b)
