# Grasshopper definition 03_fractals.ghx (Grasshopper 0.9.75)
# plug-ins: Decodes Python Interpreter

# ---- group: L-system Branching
line = Line(Line((0, 0, 0), (0, 55, 0)))
series = Series(Start=0, Step=1, Count=Slider(10, range=1..10))
expression = Expression(x=series, Expression="20/(x+1)")
decodes = DecodesPythonScript(seed_lines=line, steps=series)  # -> console, a; inputs seed_lines: list, steps: Int32
# ---------- decodes: Python ----------
divs = [ 1, 1, 1 ]
height_ratio = 1/3

for step in range(steps):
    new_lines = []
    for line in seed_lines:
        height = line.length*height_ratio
        pts = [line.eval(t) for t in divs]
        vec_1 = line.vec.cross(Vec(0,0,1)).normalized(height)
        vec_2 = line.vec.normalized(height)
        pts[0] += vec_1 + vec_2 + vec_2
        pts[2] += -vec_1 + vec_2 + vec_2
        new_lines.extend( [Segment(pts[1],pts[0]), Segment(pts[1],pts[2])] )
    seed_lines = new_lines

a.put(seed_lines)
# ---------- end decodes ----------
decodes_2 = DecodesPythonScript(lines=decodes.a, w=expression)  # -> console, a, a_props
# ---------- decodes_2: Python ----------
lines.set_weight(w)
a.put(lines)
# ---------- end decodes_2 ----------
# Courtesy of Feijiao Huo, work done in ARCH-2347
hardboil = DecodesHardBoil(Geometry=decodes_2.a, Properties=decodes_2.a_props)

# ----
decodes_3 = DecodesPythonScript(sides=Slider(5, range=3..10))  # -> console, a; inputs sides: Int32
# ---------- decodes_3: Python ----------
rg = RGon(sides,radius=5.0)
for edge in rg.edges: a.put(edge)
# ---------- end decodes_3 ----------
line_2 = Line(Line((10, 0, 0), (-1, -5, 0)))

# ---- group: monster_2d
# a
decodes_4 = DecodesPythonScript(aa=Slider(5, range=0..10), bb=Slider(1.5, range=0..10))  # -> console, a
# ---------- decodes_4: Python ----------
from math import pi, cos, sin

def evaluate(t):
    x = (aa-bb)*cos(t) + bb*cos(t*((aa/bb)-1))
    y = (aa-bb)*sin(t) + bb*sin(t*((aa/bb)-1))
    return Point(x,y)
    
cnt = 10
pts = [evaluate(t) for t in Interval(0, 2*pi).divide(cnt, True)]

curve_lines = [Segment(pts[n], pts[n+1]) for n in range(cnt)]

a.put(curve_lines)
# ---------- end decodes_4 ----------

# ----
number_slider = Slider(3, range=1..6)

# ---- group: L-system Branching / Line Replacement Rule
decodes_5 = DecodesPythonScript(line_in=line)  # -> console, out
# ---------- decodes_5: Python ----------
#notice that a line input from Grasshopper is read in as a Segment


divs = [ 1, 1, 1 ]
height_ratio = 1/3

height = line_in.length*height_ratio
pts = [line_in.eval(t) for t in divs]
vec_1 = line_in.vec.cross(Vec(0,0,1)).normalized(height)
vec_2 = line_in.vec.normalized(height)
pts[0] += vec_1 + vec_2 + vec_2
pts[2] += -vec_1 + vec_2

new_lines = [Segment(pts[n],pts[n+1]) for n in range(len(pts)-1)] 


out.put(new_lines)
# ---------- end decodes_5 ----------

# ---- group: (Koch) Fractal
# c
decodes_6 = DecodesPythonScript(seed_lines=line_2, steps=number_slider)  # -> console, a; inputs seed_lines: list, steps: Int32
# ---------- decodes_6: Python ----------
divs = ( 0 , 1/3 , 0.5 , 2/3 , 1 )
height_ratio = 1/3

for step in range(steps):
    new_lines = []
    for line in seed_lines:
        height = line.length*height_ratio
        pts = [line.eval(t) for t in divs]
        vec = line.vec.cross(Vec(0,0,1)).normalized(height)
        pts[2] += vec
        new_lines.extend( [Segment(pts[n],pts[n+1]) for n in range(len(pts)-1)] )
    seed_lines = new_lines
    
a.put(seed_lines)
# ---------- end decodes_6 ----------

# ---- group: Line Replacement Rule
# b
decodes_7 = DecodesPythonScript(line_in=line_2, steps=number_slider)  # -> console, a; inputs steps: Int32
# ---------- decodes_7: Python ----------
divs = ( 0 , 1/3 , 0.5 , 2/3 , 1 )
height_ratio = 1/3

height = line_in.length*height_ratio
pts = [line_in.eval(t) for t in divs]
vec = line_in.vec.cross(Vec(0,0,1)).normalized(height)
pts[2] += vec
new_lines = [Segment(pts[n],pts[n+1]) for n in range(len(pts)-1)] 
    
a.put(new_lines)
# ---------- end decodes_7 ----------
