# Grasshopper definition 04_inflation.ghx (Grasshopper 0.9.75)
# plug-ins: Decodes Python Interpreter

# ---- group: polygons
# polygon (PGon)
# stock polygons (rectangle, doughnut)
# regular polygon (RGon)
number_slider = Slider(9.5, range=1..20)
md_slider = MDSlider(
    slider_value=Point(0.547712326, 0.1529901028, 0.5),
    SliderMode=0,
    x_domain=Domain(0, 1),
    y_domain=Domain(0, 1),
    z_domain=Domain(0, 1))
md_slider_2 = MDSlider(
    slider_value=Point(0.4275001287, 0.222499609, 0.5),
    SliderMode=0,
    x_domain=Domain(0, 10),
    y_domain=Domain(0, 10),
    z_domain=Domain(0, 1))
# a
xy = XYPlane(Origin=md_slider)
decodes = DecodesPythonScript(pt=md_slider_2, width=Slider(30, range=1..30), height=number_slider, side=Slider(3, range=0..3))  # -> console, a, b; inputs side: Int32
# ---------- decodes: Python ----------
"""
The PGon class offers static methods for easily constructing useful 'stock' polygons in 2D.
"""
from math import pi

#Rectangle
center = Point(5,0)

rect = PGon.rectangle(center, width, height)
a.put(rect)


#some polygon properties
#sides can be accessed by index (for a rectangle: 0,1,2,3)
edge = rect.edges[side]
print edge
#points along sides can be accessed using eval
pt_on_poly =  edge.eval(0.5)
b.put(pt_on_poly)
# ---------- end decodes ----------
decodes_2 = DecodesPythonScript(cs=xy)  # -> console, a, b
# ---------- decodes_2: Python ----------
"""
The basic construction of a PGon. 
"""
pts_a = [Point(-10,0),Point(-8,1),Point(-6,0),Point(-8,-1)]
pg_a = PGon(pts_a)

a.put(pg_a)
# ---------- end decodes_2 ----------
decodes_3 = DecodesPythonScript(
    sides=Slider(6, range=0..10),
    edge=Slider(2.202, range=0..10),
    apoth=Slider(3.208, range=0..10),
    rad=Slider(4.538, range=0..10))  # -> console, a, b, c; inputs sides: Int32
# ---------- decodes_3: Python ----------
"""
Regular polygons can be constructed either by specifying the edge length, apothem 
(distance from center midpoint of edge or radius (distance from center to a vertex) 
"""

#if no center is specified this defaults to a center of (0,0,0)
my_rgon=RGon(num_of_sides=sides, edge_length=edge)
a.put(my_rgon)

center = Point(5,0)
my_rgon2=RGon(basis = CS(center), num_of_sides=sides, apothem=apoth)
b.put(my_rgon2)

center += Vec(10,0)
my_rgon3 = RGon(basis = CS(center), num_of_sides = sides, radius = rad)
c.put(my_rgon3)
# ---------- end decodes_3 ----------

# ----
number_slider_2 = Slider(30, range=1..30)
t = Slider(0.5, range=0..1)

# ---- group: inflation
# b
decodes_4 = DecodesPythonScript(pgon=decodes_3.c, t=t, steps=number_slider_2)  # -> console, out; inputs steps: Int32
# ---------- decodes_4: Python ----------
for n in range(steps):
    pts = []
    for edge in pgon.edges:
        pts.append(edge.eval(t))
    new_pgon = PGon(pts)
    out.put(new_pgon)
    pgon = new_pgon
# ---------- end decodes_4 ----------

# ---- group: same as above encapsulated as a function
# c
decodes_5 = DecodesPythonScript(pgon=decodes_3.a, t=t, steps=number_slider_2)  # -> console, out; inputs steps: Int32
# ---------- decodes_5: Python ----------
def inflate(polygon, param):
    pts = [edge.eval(param)for edge in polygon.edges]
    return PGon(pts)

for n in range(steps):
    new_pgon = inflate(pgon, t)
    out.put(new_pgon)
    pgon = new_pgon
# ---------- end decodes_5 ----------
