# Grasshopper definition 05_guilloche.ghx (Grasshopper 0.9.75)
# plug-ins: Decodes Python Interpreter

tolerence = Slider(0.03, range=0.01..0.1)  # disabled

# ---- group: smooth guilloche
number_slider = Slider(3, range=0..10)  # disabled
number_slider_2 = Slider(3, range=0..10)  # disabled
# b
line = Line(Line((0, 12, 0), (10, 12, 0)))  # disabled
line_2 = Line(Line((0, 10, 0), (9.996711624, 9.140671672, 0)))  # disabled
decodes = DecodesPythonScript(seg_a=line, seg_b=line_2, chain_count=number_slider, hump_count=number_slider_2)  # -> console, a; inputs chain_count: Int32, hump_count: Int32; disabled
# ---------- decodes: Python ----------
chains = []
res = 50
twopi = Interval.twopi()
for n in range(chain_count):
    t = (n/chain_count)
    pts = []
    off = (math.pi * 2 / hump_count) * t
    for y in Interval().divide(res,True):
        pt_a = seg_a.eval(y)
        pt_b = seg_b.eval(y)
        theta = twopi.eval(y)+off
        tt = (1.0 + math.sin(theta*hump_count))/2
        pts.append(Point.interpolate(pt_a,pt_b,tt))
    chain = []
    for n in range(len(pts)-1): chain.append(Segment(pts[n],pts[n+1]))
    chains.append(chain)
    
a.put(chains)
# ---------- end decodes ----------

# ---- group: rough guilloche
# a
line_3 = Line(Line((0, 12, 0), (10, 12, 0)))
line_4 = Line(Line((0, 10, 0), (9.996711624, 9.140671672, 0)))
decodes_2 = DecodesPythonScript(seg_a=line_3, seg_b=line_4, hump_count=Slider(5, range=1..10), t=Slider(0.36, range=0..1))  # -> console, a; inputs hump_count: Int32
# ---------- decodes_2: Python ----------
"""
A Bad Guilloche
"""

res = 30
pts = []
off = (math.pi * 2 / hump_count) * t
twopi = Interval.twopi()
for y in Interval().divide(res,True):
    pt_a = seg_a.eval(y)
    pt_b = seg_b.eval(y)
    theta = twopi.eval(y)+off
    tt = (1.0 + math.sin(theta*hump_count))/2
    pts.append(Point.interpolate(pt_a,pt_b,tt))
    
chain = []
for n in range(len(pts)-1): 
    chain.append(Segment(pts[n],pts[n+1]))
    
a.put(chain)
# ---------- end decodes_2 ----------

# ---- group: ellipse
slider = Slider(6.386, range=1..10)  # disabled
slider_2 = Slider(9.408, range=1..10)  # disabled
decodes_3 = DecodesPythonScript(len_x=slider_2, len_y=slider, tol=tolerence)  # -> console, a; disabled
# ---------- decodes_3: Python ----------
import math

def func(t):
    c = math.cos(2*math.pi*t)
    s = math.sin(2*math.pi*t)
    pt_out = Point(len_x*c, len_y*s)
    return pt_out
     
     
a.put(Curve(func,tolerance=tol))
# ---------- end decodes_3 ----------

# ---- group: circle
slider_3 = Slider(5.936, range=1..10)  # disabled
slider_4 = Slider(8, range=1..10)  # disabled
decodes_4 = DecodesPythonScript(len_x=slider_4, len_y=slider_3, tol=tolerence)  # -> console, a; disabled; same code as decodes_3

# ---- group: diamond
slider_5 = Slider(5.901, range=1..10)  # disabled
slider_6 = Slider(4.469, range=1..10)  # disabled
decodes_5 = DecodesPythonScript(len_x=slider_5, len_y=slider_6, tol=tolerence)  # -> console, a; disabled
# ---------- decodes_5: Python ----------
import math

def func(t):
    t_value = 2*math.pi*t
    c = math.cos(t_value)
    s = math.sin(t_value)
    pt_out = Point(len_x*abs(c)*c, len_y*abs(s)*s)
    return pt_out
     

a.put(Curve(func,tolerance=tol))
# ---------- end decodes_5 ----------

# ---- group: Hypocycloid
slider_7 = Slider(10, range=1..10)  # disabled
slider_8 = Slider(4, range=1..20)  # disabled
decodes_6 = DecodesPythonScript(len_x=slider_7, num_cusps=slider_8, tol=tolerence)  # -> console, a; disabled
# ---------- decodes_6: Python ----------
import math

def func(t):
    t_value = 2*math.pi*t
    c = math.cos(t_value)
    s = math.sin(t_value)
    c_n = math.cos((num_cusps-1)*t_value)
    s_n = math.sin((num_cusps-1)*t_value)
    #pt_out = Point(len_x*c*c*c, len_y*s*s*s)
    factor = len_x/num_cusps
    pt_out = Point(factor*((num_cusps-1)*c - c_n), factor*((num_cusps-1)*s + s_n))
    
    return pt_out
     

a.put(Curve(func,tolerance=tol))
# ---------- end decodes_6 ----------

# ---- group: teardrop
slider_9 = Slider(3.942, range=1..10)  # disabled
slider_10 = Slider(4.886, range=1..10)  # disabled
slider_11 = Slider(4, range=1..10)  # disabled
decodes_7 = DecodesPythonScript(len_x=slider_9, len_y=slider_10, n=slider_11, tol=tolerence)  # -> console, a; disabled
# ---------- decodes_7: Python ----------
import math

def func(t):
    t_value = 2*math.pi*t
    c = math.cos(t_value)
    s = math.sin(t_value)
    pt_out = Point(len_x*c, len_y*(math.sin(math.pi*t)**n)*s)
    return pt_out
    
a.put(Curve(func,tolerance=tol))
# ---------- end decodes_7 ----------

# ----
curve_a = Data(decodes_4.a)  # disabled
curve_b = Data(decodes_7.a)  # disabled
number_slider_3 = Slider(3, range=0..50)  # disabled
number_slider_4 = Slider(10, range=1..50)  # disabled
number_slider_5 = Slider(100, range=20..200)  # disabled
decodes_8 = DecodesPythonScript(curve_a=curve_a, curve_b=curve_b)  # -> console, a; disabled
# ---------- decodes_8: Python ----------
a.put(curve_a.surrogate)
a.put(curve_b.surrogate)
# ---------- end decodes_8 ----------
# requires understanding functions and curves
decodes_9 = DecodesPythonScript(curve_a=curve_a, curve_b=curve_b, chain_count=number_slider_4, hump_count=number_slider_3, res=number_slider_5)  # -> console, a; inputs chain_count: Int32, hump_count: Int32, res: Int32; disabled
# ---------- decodes_9: Python ----------
def guilloche_line(t):
    pts = []
    off = (math.pi * 2 / hump_count) * t
    for y in Interval().divide(res,True):
        pt_a = curve_a.eval(y)
        pt_b = curve_b.eval(y)
        theta = Interval.twopi().eval(y)+off
        v = 0.5 + math.sin(theta*hump_count)/2
        pts.append(Point.interpolate(pt_a,pt_b,v))
    return(PLine(pts))
    
plines = []    
for n in range(chain_count):
    pl = guilloche_line(n/chain_count)
    plines.append(pl)

a.put(plines)
# ---------- end decodes_9 ----------
