# Grasshopper definition 06_monsters.ghx (Grasshopper 0.9.75)
# plug-ins: Decodes Python Interpreter

minor_radius = Slider(2.7, range=0..10)
major_radius = Slider(3.8, range=0..10)

# ---- group: monsters_2d
slider = Slider(90, range=0..100)
decodes = DecodesPythonScript(aa=Slider(-1.2, range=-10..10), bb=Slider(6, range=-10..10), pt_count=slider)  # -> console, a, b, c; inputs pt_count: Int32
# ---------- decodes: Python ----------
from math import *

# In our mathematical monsters exercise, we had written something like this:
#
#ival = Interval(0,pi*2)
#pt_count = 100
#for t in ival.divide(pt_count, include_last = True):
#    x = (aa-bb)*cos(t) + bb*cos(t*((aa+bb)-1))
#    y = (aa-bb)*sin(t) + bb*sin(t*((aa+bb)-1))
#    a.put(Point(x,y))

# This could be re-written using a function like so:

def evaluate(t):
    x = (aa-bb)*cos(t) + bb*cos(t*((aa+bb)-1))
    y = (aa-bb)*sin(t) + bb*sin(t*((aa+bb)-1))
    return Point(x,y)

pts = []
ival = Interval(0,pi*2)
for t in ival.divide(pt_count, include_last = True): 
    pts.append(evaluate(t))


a.put(pts)
b.put(PLine(pts))
c.put(evaluate)
# ---------- end decodes ----------
crv = Curve(decodes.b)

# ---- group: a helix with a freeform profile
# b
number_slider = Slider(28, range=1..28)
decodes_2 = DecodesPythonScript(
    height=number_slider,
    rad_cap=Slider(6.2, range=0..10),
    rad_mid=Slider(-2.9, range=-4..10),
    mid_height=Slider(0.7, range=0..1),
    turns=Slider(5.92, range=1..10),
    k=Slider(2, range=0.6..3))  # -> console, a
# ---------- decodes_2: Python ----------
#helical curve defined by a profile defined by a 3 pt Bezier curve 
from math import *

rad_min = 1
offset = 0.2

def point_by_cyl_coords(radius,radians,z):
    x = radius * math.cos(radians)
    y = radius * math.sin(radians)
    return Point(x,y,z)

def func_rad(t):
    pt_a = Point(rad_cap,0)
    pt_b = Point(rad_mid,mid_height*height)
    pt_c = Point(rad_cap,height)
    rad = Curve.bezier([pt_a,pt_b,pt_c]).eval(t/height).x
    return rad
 
def func_theta(t):
    theta = 2*turns*pi*(t/height)**k
    return theta

def func_helix(t):
    rad = func_rad(t)
    theta = func_theta(t)
    return point_by_cyl_coords(rad, theta, t)

ival = Interval(0,height)
crv = Curve(func_helix, ival, height/100)
a.put(crv.surrogate)
# ---------- end decodes_2 ----------

# ----
# a torus made of points: uses nested loops to make a torus of points, with no collections required.
decodes_3 = DecodesPythonScript(r=minor_radius, R=major_radius)  # -> console, a
# ---------- decodes_3: Python ----------
from math import *

"""
Equation for the Torus
    x = (R + r*cos(v))*cos(u)
    y = (R + r*cos(v))*sin(u)
    z = r*sin(v)
    domain = [0, 2*pi]x[0, 2*pi]
"""

res_u = 20
res_v = 10

for u in Interval(0,pi*2)/res_u:
    for v in Interval(0,pi*2)/res_v:
        x = (R+r*cos(v))*cos(u)
        y = (R+r*cos(v))*sin(u)
        z = r*sin(v)
        a.put(Point(x,y,z))
# ---------- end decodes_3 ----------
# a torus made of lines: uses a collection to store points so that we can run lines through the points
decodes_4 = DecodesPythonScript(r=minor_radius, R=major_radius)  # -> console, a
# ---------- decodes_4: Python ----------
from math import *

"""
Equation for the Torus
    x = (R + r*cos(v))*cos(u)
    y = (R + r*cos(v))*sin(u)
    z = r*sin(v)
    domain = [0, 2*pi]x[0, 2*pi]
"""


res_u = 20
res_v = 10

all_pts = []
for u in Interval(0,pi*2)/res_u:
    row_pts = []
    for v in Interval(0,pi*2)/res_v:
        x = (R+r*cos(v))*cos(u)
        y = (R+r*cos(v))*sin(u)
        z = r*sin(v)
        row_pts.append(Point(x,y,z))
    all_pts.append(row_pts)


for n in range(len(all_pts)) : 
    for m in range(len(all_pts[n])) : 
        a.put(Segment(all_pts[n][m-1],all_pts[n][m]))
        a.put(Segment(all_pts[n-1][m],all_pts[n][m]))
# ---------- end decodes_4 ----------

# ---- group: torus as a decodes surface
# c
decodes_5 = DecodesPythonScript(r=minor_radius, R=major_radius)  # -> console, a, b
# ---------- decodes_5: Python ----------
"""
Equation for the Torus
    x = (R + r*cos(v))*cos(u)
    y = (R + r*cos(v))*sin(u)
    z = r*sin(v)
    domain = [0, 2*pi]x[0, 2*pi]
"""

from math import *

def torus(u,v):
    x = (R + r*cos(v))*cos(u)
    y = (R + r*cos(v))*sin(u)
    z = r*sin(v)
    return Point(x,y,z)

surf = Surface(torus, Interval.twopi(), Interval.twopi())
a.put(surf)
b.put(surf.surrogate)
# ---------- end decodes_5 ----------
mesh = Mesh(decodes_5.b)

# ---- group: a simple curve class
decodes_6 = DecodesPythonScript()  # -> console, a
# ---------- decodes_6: Python ----------
class Curve():
    def __init__(self, function, domain=Interval(0,1), tolerance=None):
        self.func = function
        self.domain = domain
        self.tol = self.tol_max
        if tolerance is not None : self.tol = tolerance
        
    @property
    def tol_max(self): return self.domain.delta / 10.0
    
    def deval(self,t):
        """ Evaluates this Curve and returns a Point.
        t is a float value that falls within the defined domain of this Curve.
	"""
        pt = self.func(t)
        return pt

    def eval(self,t):
        """ Evaluates this Curve and returns a Point.
        t is a normalized float value (0->1) which will be remapped to the domain
        defined by this Curve.
        """
        return self.deval(Interval.remap(t,Interval(),self.domain))

    @property
    def surrogate(self):
        res = int(math.ceil(self.domain.delta/self.tol))
        t_vals = self.domain.divide(res,True)
        return PLine([self.deval(t) for t in t_vals])
# ---------- end decodes_6 ----------

# ---- group: monsters as a decodes curve
# a
decodes_7 = DecodesPythonScript(func=decodes.c, pt_count=slider)  # -> console, a; inputs pt_count: Int32
# ---------- decodes_7: Python ----------
from math import *

    
ival = Interval(0,2*pi)
tol = ival.delta/pt_count
crv = Curve(func,ival,tol)

a.put(crv.surrogate)
# ---------- end decodes_7 ----------
