# Grasshopper definition 4.01.L02_dressedTiling.ghx (Grasshopper 0.9.75)
# plug-ins: Decodes Python Interpreter

line = Line(Line((0, 0, 0), (0, 6, 0)))

# ---- group: snub square tiling - by cell
decodes = DecodesPythonScript(seed_edge=line)  # -> console, a
# ---------- decodes: Python ----------
'''
4.01.L02a
Given a snub square tiling, scale the original RGons according to a distance to a given point. Create a mesh with the new and the original RGon and color the Mesh based on the distance factor.  

required:
cell ([Pline]) Base geometries to mesh.
force (float) Attractor force to offset geometries.
clr_a (Color) First color to interpolate.
clr_b (Color) Second color to interpolate.

result:
ret ([Mesh]) Meshes with color attributes created by offsetting an original geometry.
'''
"""
Methods for creating a mesh and assign a given color to the mesh. 
"""

# Create a cluster with four triangles, and two squares
def cluster(sedg):
    tri_a = RGon.from_edge(edge,3)
    tri_b = RGon.from_edge(edge.inverted(),3)
    sq_a = RGon.from_edge(tri_a.edges[0],4)
    sq_b = RGon.from_edge(tri_b.edges[1],4)
    tri_c = RGon.from_edge(sq_a.edges[0],3)
    tri_d = RGon.from_edge(sq_a.edges[2],3)
    return [tri_a,tri_b,sq_a,sq_b,tri_c,tri_d]

# Get the translation vector to move at the end of a cluster in X direction
def xf_x(cluster):
    # Get the first item in the cluster
    tri_a = cluster[0]
    # Get the distance from the midpoint of the first edge to the ept of a second edge of a geometry
    tri_height = tri_a.edges[0].midpoint.distance(tri_a.edges[1].ept)
    # Get the cross vector of the seed edge and the Z vector
    vec = seed_edge.vec.cross(Vec(0,0,1))
    # Re-scale the translation vector with the square of the triangle height + the length of the seed edge
    vec = vec.normalized(tri_height*2+seed_edge.length)
    # Create the translation transformation with the vector
    return vec

def xf_y(cluster,is_odd):
    # Get the first item in the cluster
    tri_a = cluster[0]
    # Get the distance from the midpoint of the first edge to the ept of a second edge of a geometry
    tri_height = tri_a.edges[0].midpoint.distance(tri_a.edges[1].ept)
    # Use the seed edge as a vector 
    vec = seed_edge.vec
    # Change the length of the vector to the height of the triangle + half the length of a seed edge
    vec = vec.normalized( tri_height+seed_edge.length/2.0 )
    dx = tri_height+seed_edge.length/2.0
    # If the row number is odd multiply the translation distance * -1
    if is_odd : dx *=-1
    # Add the previous vector and the normalized cross product of the vector and the Z vector
    vec += vec.cross(Vec(0,0,1)).normalized(dx)
    # Create the translation transformation with the vector
    return vec

# seed_edge = Segment(Point(),Point(0,1))
# make sure seed edge is 2d
seed_edge._pt.z = 0
seed_edge._vec.z = 0

# Make a list for all the clusters
clusters = []
# Create a number of rows of clusters
for v in range(3):
    row_clusters = []
    # Get the starting edge for every row
    edge = Segment(seed_edge.spt,seed_edge.ept)
    # Create a number of columns of clusters
    for u in range(3):
        # Create a cluster on every edge of a cluster
        new_cluster = cluster(edge)
        row_clusters.append(new_cluster)
        # Translate the custer to the end point of the previous column
        edge += xf_x(new_cluster)
        
    clusters.append(row_clusters)
    # Add a new row of clusters
    seed_edge += xf_y(new_cluster,v%2==0)

a.put(clusters)
# ---------- end decodes ----------

# ---- group: Truncated square tiling by lattice
decodes_2 = DecodesPythonScript(u_cnt=Slider(2, range=1..5), v_cnt=Slider(5, range=1..5))  # -> console, a; inputs u_cnt: Int32, v_cnt: Int32
# ---------- decodes_2: Python ----------
# Create three segments for every node
def node(seed,flags):
    rgons = []
    # Create an RGon based on some flags
    for n in flags:
        rgons.append(RGon.from_edge(seed,n))
        seed = rgons[-1].edges[0]
    
    # Create a Segment half the length of every edge of the RGon
    segs = [Segment(rgon.pts[0],Vec(rgon.pts[0],rgon.pts[1])/2.0) for rgon in rgons]
    return segs

# Starting Segment for the tiling
seed = Segment(Point(1,1),Vec(0,1))
# Truncated square tiling
flags = (4,8,8) 

# Number of nodes per cluster
nodes_per_clst = 4
clst_per_row = u_cnt

sqrt2 = 2**0.5 # the width of an octogon is 1+sqrt(2)*side_length

for n in range(u_cnt*v_cnt*nodes_per_clst):
    if n>0 and n%nodes_per_clst==0:
        # translations between u-clusters
        seed._pt += Vec(1+sqrt2*seed.length+seed.length,0)
    if n>0 and n%(nodes_per_clst*clst_per_row)==0:
        # translations between v-clusters
        dy = 1+sqrt2*seed.length+seed.length
        #alternate odd and even rows
        if n%(nodes_per_clst*clst_per_row*2)==0 : dx = -dy*(clst_per_row+0.5)
        else : dx = -dy*(clst_per_row-0.5)
        seed += Vec(dx,dy/2.0)
    if n>0:
        # translations within a cluster
        seed = Segment(seed.ept,seed._vec.cross(Vec(0,0,1)))
    
    cur_node = node(seed,flags)
    a.put(cur_node)
# ---------- end decodes_2 ----------

# ---- group: create a component from a polygon tile and mesh it
# a
swatch = ColourSwatch(SwatchColor=RGB(255, 128, 0))
decodes_3 = DecodesPythonScript(pgon=flatten(decodes.a), force=Slider(50, range=20..300), clr_a=ColourSwatch(SwatchColor=RGB(255, 0, 0)), clr_b=swatch)  # -> console, a, a_props; inputs pgon: Polyline
# ---------- decodes_3: Python ----------
"""
Methods for creating a mesh and assign a given color to the mesh. 
"""
"""
Create a mesh from a pgon and an offset pgon and assign a given color to the mesh. 
"""
def mesh_tile(pgon, new_pgon, clr):
    # get the vertices of the original pgon
    pts = pgon.pts
    # get the vertices of the offset pgon
    new_pgon_pts = new_pgon.pts
    meshes = []
    cnt = len(pts)
	#for each index in the list of vertices:
    for i in range(cnt):
        # create a Mesh connecting two vertices of the original pgon with the offset pgon
        if i < cnt-1:
            mesh = Mesh([pts[i],pts[i+1],new_pgon_pts[i+1],new_pgon_pts[i]])
        else: 
            mesh = Mesh([pts[i],pts[0],new_pgon_pts[0],new_pgon_pts[i]])
        mesh.add_face(0,1,2,3)
		#set the color of the mesh
        mesh.set_color(clr)
        meshes.append(mesh)
    return meshes

"""
Set an attractor factor based on the distance between the centroid of the pgon and an attractor point
"""
attractor = Point()
factor = pgon.centroid.distance(attractor)/force
if factor < 0 : factor = 0.0
if factor > 1 : factor = 1.0
"""
Based on this attactor factor, offset the pgon and set a color
"""
new_pgon = PLine(pgon.pts) * Xform.scale(factor, Point.centroid(pgon.pts)) 
clr = Color.interpolate(clr_a,clr_b,factor)
"""
Create a mesh with the old and the new pgons
"""
mesh = mesh_tile(pgon, new_pgon, clr)

a.put(mesh)
# ---------- end decodes_3 ----------

# ----
# b
attractor_point_location = Panel("1,2")

# ---- group: create a component from a cluster of segments and mesh it
decodes_4 = DecodesPythonScript(
    segs=decodes_2.a,
    force=Slider(25, range=0..100),
    clr_a=ColourSwatch(SwatchColor=RGB(230, 230, 230)),
    clr_b=ColourSwatch(SwatchColor=RGB(255, 0, 0)),
    attr_pt=attractor_point_location)  # -> console, a, a_props; inputs segs: list, attr_pt: Point3d
# ---------- decodes_4: Python ----------
'''
4.01.L02b
Given a lattice-based tiling, scale the original Segments according to a distance to a given point. Create a mesh Segments and color the Mesh based on the distance factor.  

required:
segs ([Segment]) Base geometries to mesh.
force (float) Attractor force to offset geometries.
clr_a (Color) First color to interpolate.
clr_b (Color) Second color to interpolate.
attr_pt (Point) An attractor Point

result:
ret ([Mesh]) Meshes with color attributes created by offsetting an original geometry.
'''

"""
Set a factor of a given point which depends on the distance of point from an attractor point
[noprint]
"""
def factor(pt,attractor):
    factor = (pt.distance(attractor))/force
    # make sure the factor is at least zero
    if factor < 0 : factor = 0.0
    # make sure the factor is no larger than one
    if factor > 1 : factor = 1.0
    return factor
"""
Create base points for the center tetrahedron of our component
"""
def get_s(i, length,attractor):
    # set an s-vector based on a line segment emanating from the node
    s_vec = segs[i].vec.inverted()
	# scale it by a factor that depends on the distance to an attractor point
    s_vec.length = factor(segs[i].spt,attractor)
    # translate the startpoint of the segment by the scaled vector
    return segs[i].spt + s_vec
    
"""
Create edge points of our component by translating the endpoint of a segment in 3 different directions
"""
def get_e(i, length):
    # translate in the z-direction
    e0 = segs[i].ept + Vec(0,0,length)
	# compute a vector perpendicular to the line segment
    cross = segs[i].vec.cross(Vec(0,0,1))
    cross.length = length
    inv_cross = cross.inverted()
	# translate in the direction of this perpendicular vector
    e1 = segs[i].ept + cross
    # translate in the direction opposite of this perpendicular vector
    e2 = segs[i].ept + inv_cross
    return [e0,e1,e2]
 
"""
Functions to aid in the meshing of components.
The first creates a mesh consisting of a single quad face, and sets its color using the distance to the attractor point.
The second 'weaves' a single arm of our component using selected indices of tet points, edge points, and the apex point.
[pseudo]
"""
def mesh_quad(pt_a,pt_b,pt_c,pt_d):
    # given four points, create a mesh
    msh = Mesh([pt_a,pt_b,pt_c,pt_d])
    msh.add_face(0,1,2,3)
    # set the color of the mesh by its distance to an attractor point
    t = factor(msh.face_centroid(0),attr_pt)
    msh.set_color(Color.interpolate(clr_a,clr_b,t))
    # return the mesh
    return msh

def mesh_arm(arm_index,idxs):
    # define the edge points for this arm of the component
    epts = get_e(arm_index, 0.1)
    # using the provided indices of edge and tet points, create three quad meshes
    m0 = mesh_quad(epts[2],tet_pts[idxs[0]],apex_pt,epts[0])
    m1 = mesh_quad(epts[1],epts[0],apex_pt,tet_pts[idxs[1]])
    m2 = mesh_quad(epts[1],tet_pts[idxs[2]],tet_pts[idxs[3]],epts[2])
    return [m0,m1,m2]

"""
Setup the initial parameters and base geometries of our component, including the tetrahedron size.
Then, working one 'arm' of the component at a time, create meshes using established base geometries 
"""
# set the height of the component
height = 0.1
#a point at the apex of the center tetrahedron 
apex_pt = segs[0].spt + Vec(0,0,height)
#all the pts of the central tetrahedron
tet_pts = [get_s(i, height,attr_pt) for i in range(len(segs))]

# a container to hold resulting meshes
meshes = []

# defining the proper tet_pts to connect
t_idxs = (1,2,2,1)
# create this mesh 'arm' 
meshes_arm = mesh_arm(0,t_idxs)
meshes.extend(meshes_arm)

# follow the same pattern for the next two arms
meshes_arm = mesh_arm(1,(2,0,0,2))
meshes.extend(meshes_arm)
meshes_arm = mesh_arm(2,(0,1,1,0))
meshes.extend(meshes_arm)

# create one last mesh on the bottom of the tet
msh = Mesh([tet_pts[0],tet_pts[1],tet_pts[2]])
msh.add_face(0,1,2)
t = factor(msh.face_centroid(0),attr_pt)
msh.set_color(Color.interpolate(clr_a,clr_b,t))
meshes.append(msh)




a.put(meshes)
# ---------- end decodes_4 ----------

# ----
hardboil = DecodesHardBoil(Geometry=decodes_3.a, Properties=decodes_3.a_props)
hardboil_2 = DecodesHardBoil(Geometry=decodes_4.a, Properties=decodes_4.a_props)
