# Grasshopper definition 4.01.L05_danzerTiling.ghx (Grasshopper 0.9.75)
# plug-ins: Decodes Python Interpreter

rad_in = Panel("0.20")  # disabled
rad_out = Panel("0.25")  # disabled
# b
slider = Slider(2, range=0..5)

# ---- group: Danzer Classes
# a
decodes = DecodesPythonScript()  # -> console, a, b, c, k
# ---------- decodes: Python ----------
'''
4.01.L05a

members:

methods:

'''

"""
Defines a base class from which to derive each child class, and contains methods applicable to all Danzer prototiles
"""
# golden ratio (0.618033989)
tau = 2 / (1 + math.sqrt(5))
# powers of golden ratio, used for scaling tiles
tau_pow = [tau**n for n in range(10)]

class DzTile(object):
        
    def __init__(self,**kargs):
        #lineage, tracks tile types of ancestors
        self.lineage = kargs["lineage"] if "lineage" in kargs else "RT" 
        #recursion level, sets the scale of tiles
        self.rlvl = kargs["rlvl"] if "rlvl" in kargs else 0 
        #the spatial transformation of this tile
        self.xf = kargs["xf"] if "xf" in kargs else Xform() 
        #determines if this tile is mirrored
        self.flip = kargs["flip"] if "flip" in kargs else False
        
    """
    Retrieves vertices of Danzer tiles in world coordinates
    [pseudo]
    """
    @property
    def tile_pts(self):
        # calculate a scaling factor based upon this tile's recursion level
        #factor = math.pow(taui,self.rlvl)
        factor = tau_pow[self.rlvl]
        xf_scale = Xform.scale(factor)
        # return a TRANSLATED and SCALED copy of each pt in this tile's base_pts 
        return map(lambda pt:(pt*xf_scale)*self.xf,self._base_pts)
        
    """
    Constructs a child tile of the specified type, positioned by matching a CS on this tile with a CS on the desired child tile
    """        
    def child_by_explicit(self,name,cs_chld,cs_self,flip):
        # construct a world-space cs of the desired child tile
        cs_tile = CS()*Xform.change_basis(cs_chld,cs_self)*self.xf
        # the transformation from world origin to this cs
        xf = cs_tile.xform
        if flip : xf = xf * Xform.mirror()
        # set the recursion level to one more than this tile
        rl = self.rlvl + 1
        # construct the lineage string
        l = self.lineage+","+name
        f = flip
        
        # return a child tile of the desired type
        if name.startswith("A"): return DzTileA(xf=xf,rlvl=rl,lineage=l,flip=f)
        if name.startswith("B"): return DzTileB(xf=xf,rlvl=rl,lineage=l,flip=f)
        if name.startswith("C"): return DzTileC(xf=xf,rlvl=rl,lineage=l,flip=f)
        if name.startswith("K"): return DzTileK(xf=xf,rlvl=rl,lineage=l,flip=f)

    """
    Constructs a child tile of the specified type, positioned by matching a CS on this tile with the base CS of the desired child tile
    """
    def child_by_base(self,tile_chld,cs_self,flip):
        return self.child_by_explicit(tile_chld,CS(),cs_self,flip)
    
    """
    Constructs a sibling tile of the specified type, positioned by mirroring this tile about a given CS
    [pseudo]
    """
    def sibling_by_mirror(self,name,cs_mir):
        # construct the transformation of the desired child tile by mirroring
        xf = Xform.mirror(cs_mir) * self.xf
        # prepare other required arguments by modifying this tile's properties
        rl = self.rlvl
        l = self.lineage[:-2]+name
        f = not self.flip
        
        # return a child tile of the desired type
        if name.startswith("A"): return DzTileA(xf=xf,rlvl=rl,lineage=l,flip=f)
        if name.startswith("B"): return DzTileB(xf=xf,rlvl=rl,lineage=l,flip=f)
        if name.startswith("C"): return DzTileC(xf=xf,rlvl=rl,lineage=l,flip=f)
        if name.startswith("K"): return DzTileK(xf=xf,rlvl=rl,lineage=l,flip=f)
        raise
        
    """
    Methods for constructing local-space and world-space coordinate systems given the indices of three base points at the origin, and along the x- and y-axis of the desired CS
    """
    @classmethod
    def cs_by_base_pts(cls,rlvl,pt_o,pt_x,pt_y,flip=False):
        # scale the base points to the proper size for this rlvl
        factor = tau_pow[rlvl]
        pts = [pt*factor for pt in cls._base_pts]
        
        # to orient to flipped tiles, simply invert the apex point
        if flip : pts[3] = Point(pts[3].x,pts[3].y,-pts[3].z)
        # construct and return the desired coordinate system
        return CS(pts[pt_o],pts[pt_x]-pts[pt_o],pts[pt_y]-pts[pt_o])

    def cs_by_tile_pts(self,pt_o,pt_x,pt_y):
        # construct and return the desired coordinate system
        pts = self.tile_pts
        return CS(pts[pt_o],pts[pt_x]-pts[pt_o],pts[pt_y]-pts[pt_o])

    """
    [noprint]
    """
    @property
    def to_mesh(self):
        msh = Mesh()
        for v in self.tile_pts : msh.append(v)
        if self.flip : 
            msh.add_face(0,1,2)
            msh.add_face(1,3,2)
            msh.add_face(2,3,0)
            msh.add_face(3,1,0)
        else :
            msh.add_face(0,2,1)
            msh.add_face(1,2,3)
            msh.add_face(2,0,3)
            msh.add_face(3,0,1)
        return msh
        
"""
Extends DzTile, and adds methods specific to a Danzer Tile A
"""        
class DzTileA(DzTile):
    _base_pts= ( \
            Point(0.0, 0.0, 0.0),\
            Point(0.9510565, 0.0, 0.0),\
            Point(0.6881910 , 1.3763819 , 0.0),\
            Point(0.5257311 , 0.6881910, 0.5)\
            )
    """
    Inflation routine for Tile A
    [pseudo]
    """
    def inflate(self):
        #create a child TileB by mapping child pts[2,1,0] to parent pts[0,1,3]
        cs_chld = DzTileB().cs_by_base_pts(self.rlvl+1,2,1,0 )
        cs_prnt = DzTileA().cs_by_base_pts(self.rlvl,0,1,3 )
        tileB0 = self.child_by_explicit("B0",cs_chld,cs_prnt,self.flip) # same handedness as parent
        #create a child TileC by mapping child pts[1,2,0] to parent pts[3,2,1]
        cs_chld = DzTileC().cs_by_base_pts(self.rlvl+1,1,2,0 )
        cs_prnt = DzTileA().cs_by_base_pts(self.rlvl,3,2,1 )
        tileC0 = self.child_by_explicit("C0",cs_chld,cs_prnt,self.flip) # same handedness as parent
        #create a child TileC by mapping child pts[2,3,1] to parent pts[2,0,1]
        cs_chld = DzTileC().cs_by_base_pts(self.rlvl+1,2,3,1, True )
        cs_prnt = DzTileA().cs_by_base_pts(self.rlvl,2,0,1 )
        tileC1 = self.child_by_explicit("C1",cs_chld,cs_prnt,not self.flip) # opposite handedness as parent
        #create a child TileK by mapping child pts[2,0,3] to parent pts[3,1,0]
        cs_chld = DzTileK().cs_by_base_pts(self.rlvl+1,2,0,3, True)
        cs_prnt = DzTileA().cs_by_base_pts(self.rlvl,3,1,0 )
        tileK0 = self.child_by_explicit("K0",cs_chld,cs_prnt,not self.flip) # opposite handedness as parent
        #create a child TileK by mirroring the previous tile
        cs_mir = tileK0.cs_by_tile_pts(0,1,3)
        tileK1 = tileK0.sibling_by_mirror("K1",cs_mir)
        
        #create a child TileB by mapping child pts[2,3,1] to parent pts[0,3,2]
        cs_chld = DzTileB().cs_by_base_pts(self.rlvl+1,2,3,1 )
        cs_prnt = DzTileA().cs_by_base_pts(self.rlvl,0,3,2 )
        tileB1 = self.child_by_explicit("B1",cs_chld,cs_prnt,self.flip) # same handedness as parent
        tileB2 = self.child_by_explicit("B2",cs_chld,cs_prnt,not self.flip) # opposite handedness as parent
        #create a child TileK by mapping child pts[1,0,2] to parent pts[1,3,2]
        cs_chld = DzTileK().cs_by_base_pts(self.rlvl+1,1,0,2, True)
        cs_prnt = DzTileA().cs_by_base_pts(self.rlvl,1,3,2 )
        tileK2 = self.child_by_explicit("K2",cs_chld,cs_prnt,not self.flip) # opposite handedness as parent
        #create a child TileK by mirroring the previous tile
        cs_mir = tileK2.cs_by_tile_pts(0,1,3)
        tileK3 = tileK2.sibling_by_mirror("K3",cs_mir)
        
        #create two child TileK by mirroring the previous two tiles
        cs_mir = tileK2.cs_by_tile_pts(0,2,3)
        tileK4 = tileK2.sibling_by_mirror("K4",cs_mir)##
        tileK5 = tileK3.sibling_by_mirror("K5",cs_mir)
        
        #return all children
        return [tileB0,tileC0,tileC1,tileK0,tileK1,tileB1,tileB2,tileK2,tileK3,tileK4,tileK5]

"""
Extends DzTile, and adds methods specific to a Danzer Tile B
"""    
class DzTileB(DzTile):
    _base_pts= ( \
            Point(0.0, 0.0, 0.0),\
            Point(0.9510565, 0.0, 0.0),\
            Point(0.2628656 , 1.3763819, 0.0),\
            Point(0.2628656 , 0.4253254 , 0.3090170)\
        )
    """
    Inflation routine for Tile B
    [pseudo]
    """
    def inflate(self):
        #create a child TileA by mapping child base to parent pts[3,0,1]
        cs_prnt = DzTileB().cs_by_base_pts(self.rlvl,    3,0,1 )
        tileB0 = self.child_by_base("B0",cs_prnt,not self.flip)    # opposite handdeness as parent
        #create a child TileA by mapping child base to parent pts[3,0,2]
        cs_prnt = DzTileB().cs_by_base_pts(self.rlvl,    3,0,2 )
        tileK0 = self.child_by_base("K0",cs_prnt,self.flip)# same handedness as parent
        #create a child TileK by mapping child pts[1,0,3] to parent pts[0,3,1]
        cs_chld = DzTileK().cs_by_base_pts(self.rlvl+1,    1,0,3 )
        cs_prnt = DzTileB().cs_by_base_pts(self.rlvl,    0,3,1 )
        tileK1 = self.child_by_explicit("K2",cs_chld,cs_prnt,not self.flip) # opposite handedness as parent
        #create two child TileK by mirroring the previous two tiles
        cs_mir = tileK0.cs_by_tile_pts(0,2,3)
        tileK2 = tileK0.sibling_by_mirror("K2",cs_mir)
        tileK3 = tileK1.sibling_by_mirror("K3",cs_mir)
        
        #create a child TileB by mapping child pts[2,0.1] to parent pts[1,3,2]
        cs_chld = DzTileB().cs_by_base_pts(self.rlvl+1,    2,0,1 )
        cs_prnt = DzTileB().cs_by_base_pts(self.rlvl,    1,3,2 )
        tileB1 = self.child_by_explicit("B1",cs_chld,cs_prnt,self.flip) # same handedness as parent
        #create a child TileC by mapping child pts[2,1,3] to parent pts[2,0,1]
        cs_chld = DzTileC().cs_by_base_pts(self.rlvl+1,    2,1,3 )
        cs_prnt = DzTileB().cs_by_base_pts(self.rlvl,    2,0,1 )
        tileC0 = self.child_by_explicit("C0",cs_chld,cs_prnt,self.flip) # same handedness as parent
        
        #return all children
        return [tileB0,tileK0,tileK1,tileK2,tileK3,tileB1,tileC0]

"""
Extends DzTile, and adds methods specific to a Danzer Tile C
"""    
class DzTileC(DzTile):
    _base_pts= (\
            Point(0.0, 0.0, 0.0),\
            Point(0.5877853, 0.0, 0.0),\
            Point(0.8506509 , 1.3763819, 0.0),\
            Point(0.4253254 , 0.6881910 , 0.50 )\
        )
    """
    Inflation routine for Tile C
    [pseudo]
    """
    def inflate(self):
        #create a child TileA by mapping child base to parent pts[0,1,3]
        cs_prnt = DzTileA().cs_by_base_pts(self.rlvl,    0,1,3 )
        tileA0 = self.child_by_base("A0",cs_prnt,not self.flip)    # opposite handdeness as parent
        #create a child TileK by mapping child pts[1,0,2] to parent pts[2,3,1]
        cs_chld = DzTileK().cs_by_base_pts(self.rlvl+1,    1,0,2)
        cs_prnt = DzTileC().cs_by_base_pts(self.rlvl,    2,3,1 )
        tileK0 = self.child_by_explicit("K0",cs_chld,cs_prnt,self.flip) # same handedness as parent
        #create a child TileK by mirroring the previous tile
        cs_mir = tileK0.cs_by_tile_pts(0,2,3)
        tileK1 = tileK0.sibling_by_mirror("K1",cs_mir)        
        
        #create a child TileC by mapping child pts[1,2,0] to parent pts[3,1,2]
        cs_chld = DzTileC().cs_by_base_pts(self.rlvl+1,    1,2,0)
        cs_prnt = DzTileC().cs_by_base_pts(self.rlvl,    3,1,2 )
        tileC0 = self.child_by_explicit("C0",cs_chld,cs_prnt,not self.flip) # opposite handedness as parent
        #create a child TileC by mirroring the previous tile
        cs_mir = tileC0.cs_by_tile_pts(0,2,3)
        tileC1 = tileC0.sibling_by_mirror("C1",cs_mir)   
        
        #return all children
        return [tileA0,tileK0,tileK1,tileC0,tileC1]

        
"""
Extends DzTile, and adds methods specific to a Danzer Tile K
""" 
class DzTileK(DzTile):
    _base_pts= ( \
        Point(0.0, 0.0, 0.0),\
        Point(0.9510565, 0.0, 0.0),\
        Point(0.2628656 , 0.5257311 , 0.0),\
        Point(0.2628656 , 0.3440955 , 0.250)\
        )
    """
    Inflation routine for Tile K
    """
    def inflate(self):
        #a cs at pts[3,1,0] on child tile
        cs_chld = DzTileK().cs_by_base_pts(self.rlvl+1,3,1,0)
        #a cs at pts[3,1,0] on parent tile
        cs_prnt = DzTileK().cs_by_base_pts(self.rlvl,3,0,2)
        #create a child TileK by mapping cs on child to cs on parent
        tileK0 = self.child_by_explicit("K0",cs_chld,cs_prnt,self.flip)
        
        #a cs at pts[2,0,1] on parent tile
        cs_prnt = DzTileK().cs_by_base_pts(self.rlvl,2,0,1)
        #create a child TileK by mapping child base to cs on parent
        tileB0 = self.child_by_base("B0",cs_prnt,self.flip)
        
        #return both children
        return [tileK0,tileB0]
        


        
        
        
        
a.put(DzTileA)
b.put(DzTileB)
c.put(DzTileC)
k.put(DzTileK)
# ---------- end decodes ----------

# ----
# c
pt = Point(Point(0, 0.5590391948, -2.630292881e-08))  # disabled

# ---- group: less simple usage
decodes_2 = DecodesPythonScript(rad_in=rad_in, rad_out=rad_out, center=pt)  # -> console, a, b, c, k; disabled
# ---------- decodes_2: Python ----------
'''
4.01.L05b
Create a danzer tiling from a given danzer tile. Only keep the tiles that are within a sphere.

required:
rad_in (float) Keep only the tiles within the radius.
rad_out (float) Keep only the tiles outside the radius.
center (Pouint) Center point for the tiling.

result:
ret ([Mesh]) Danzer Tiles of types a,b,c,k 
'''

from decodes.extensions.tiling_danzer import *


"""
Create a danzer tile and inflate it. Cull the tiles based on distance
"""

# Create a CS 
xf_0 = CS(Point(),Vec(0.5,0.309)).xform
# Create a Danzer tile C about an xform
tiles = [DzTileC(xf=xf_0)]

# for every generation of danzer tiles
for n in range(3):
    # Create an empty list to place inflated tiles
    next_tiles = []
    # for every tile in every generation, inflate the tile
    for tile in tiles : next_tiles.extend(tile.inflate())
    # Assign the inflated tiles to the original tiles for recurssion.
    tiles = next_tiles

# Select only those tiles that contain at least two points within the sphere
ctr = center
# radius of outside sphere
rad = rad_out
next_tiles = []
# for every tile in the tiles
for tile in tiles:
    cnt = 0
    # for every point in the tile points
    for pt in tile.tile_pts:
        # if the point is within a distance: increase the count
        if pt.distance(ctr) <= rad : cnt += 1 
    # if there is more than 1 point inside: keep the tile
    if cnt > 1: next_tiles.append(tile)
tiles = next_tiles

"""
Inflate the tiles again, and cull the tiles according to the distance to a point. Draw the remaining tiles. 
"""

# for every generation of danzer tiles
for n in range(2):
    next_tiles = []
    # for every tile in every generation, inflate the tile
    for tile in tiles : next_tiles.extend(tile.inflate())
    tiles = next_tiles

# select only those tiles that contain at least two points outside the sphere
ctr = center
# radius of inside sphere
rad = rad_in
next_tiles = []
# for every tile in the tiles
for tile in tiles:
    cnt = 0
    # for every point in the tile points
    for pt in tile.tile_pts:
        # if the point is within a distance: increase the count
        if pt.distance(ctr) >= rad : cnt += 1 
    # if there is more than 1 point outside: keep the tile
    if cnt > 1: next_tiles.append(tile)
tiles = next_tiles

# draw all remaining tiles
for tile in tiles:
    if type(tile) is DzTileA: a.put(tile.to_mesh)
    if type(tile) is DzTileB: b.put(tile.to_mesh)
    if type(tile) is DzTileC: c.put(tile.to_mesh)
    if type(tile) is DzTileK: k.put(tile.to_mesh)
# ---------- end decodes_2 ----------
mesh = Mesh(decodes_2.b)  # disabled
mesh_2 = Mesh(decodes_2.c)  # disabled
mesh_3 = Mesh(decodes_2.k)  # disabled
mesh_4 = Mesh(decodes_2.a)  # disabled

# ----
decodes_3 = DecodesPythonScript(DzTileA=decodes.a, DzTileB=decodes.b, DzTileC=decodes.c, DzTileK=decodes.k)  # -> console, a, a_props
# ---------- decodes_3: Python ----------
tiles = []

ta = DzTileA(xf = CS().on_xz(0,2).xform)
tiles.extend(ta.inflate())

tb = DzTileB(xf = CS().on_xz(1,2).xform)
tiles.extend(tb.inflate())

tc = DzTileC(xf = CS().on_xz(2,2).xform)
tiles.extend(tc.inflate())

tk = DzTileK(xf = CS().on_xz(3,2).xform)
tiles.extend(tk.inflate())

tilesg2 = []
for tile in tiles:
    tilesg2.extend(tile.inflate())

out = tilesg2

for tile in out:
    msh = tile.to_mesh
    msh.set_name(tile.lineage)
    a.put(msh)
# ---------- end decodes_3 ----------

# ---- group: simple usage
decodes_4 = DecodesPythonScript(iterations=slider)  # -> console, a; inputs iterations: Int32
# ---------- decodes_4: Python ----------
'''
4.01.L05b
Create a DzTile object and inflate the tile.

required:
iterations (int) Number of subdivisions.

result:
tiles ([DzTile]) Inflated Danzer Tiles.
'''

"""
Create a DzTile tile, inflate it a number of times.
"""
# import the DzTile tiling extension
from decodes.extensions.tiling_danzer import *

# create the DzTileA seed
tiles = [DzTileA()]

# for every generation of tiles:
for n in range(iterations):
    # create a container to hold inflated tiles
    next_tiles = []
    # for every tile in the current generation:
    for tile in tiles : 
        #inflate the tile, and store the results
        next_tiles.extend(tile.inflate())
    # set things up for the next generation of inflation
    tiles = next_tiles

a.put([tile.to_mesh for tile in tiles])
# ---------- end decodes_4 ----------

# ----
hardboil = DecodesHardBoil(Geometry=decodes_3.a, Properties=decodes_3.a_props)
