# Grasshopper definition 4.02.F01_Sabin.ghx (Grasshopper 0.9.75)
# plug-ins: Decodes Python Interpreter

geo = Geometry(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)
pt = Point([Point(0.875, 0.5, 0), Point(0.8829138727, 0.5165545809, 0), Point(0.8508684264, 0.5014557325, 0), Point(0.8711272469, 0.4781826754, 0), Point(0.8917288945, 0.4948501269, 0), Point(0.8580316974, 0.513827789, 0)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])
evalsrf = EvaluateSurface(Surface=reparameterize(geo), Point=pt)  # -> Point, Normal, Frame
popgeo = PopulateGeometry(Geometry=geo, Count=Slider(200, range=0..1000), Seed=1)

# ----
# b
number_slider = Slider(1, range=0..10)

pt_2 = Point(popgeo)

# ----
# a
number_slider_2 = Slider(0, range=0..10)
decodes = DecodesPythonScript(point_cloud=pt_2, count=number_slider_2)  # -> console, a; inputs point_cloud: list, count: Int32
# ---------- decodes: Python ----------
from decodes.extensions.graph import SpatialGraph


"""
Proximity Edges
Adds edges to a given SpatialGraph such that each Point forms connections with a given number of Points nearest to it.
"""
def add_proximity_connections(gph,val=5):
    for p1 in gph.nodes:
        # make a list of all points in the graph without pt
        others = [p for p in gph.nodes if p != p1]
        # sort them by distance to pt
        others.sort(key = lambda p: p.distance2(p1))
        # return the closest ones
        others = others[:val]
        for p2 in others:
            gph.add_edge(p1,p2,bidirectional=False,check_validity=False)
        
        
"""
Divide Edges Method
Subdivides a given graph's edges a given number of times, and returns the resulting points.
"""
def divide_edges(gph, divs=4):
    ret = []
    t_vals = (Interval()/divs)[1:]
    for spt, epts in gph.edges.items():
        for ept in epts:
            ret.extend([Point.interpolate(spt,ept,t) for t in t_vals])
    return ret

"""
SpatialGraph Inflation Routine
Constructs and successively divides a SpatialGraph, reconstructing its edges based on proximity at each step.
"""

graph = SpatialGraph(point_cloud)
add_proximity_connections(graph)

for n in range(count):
    inflated_graph = SpatialGraph(graph.nodes)
    for pt in divide_edges(graph): inflated_graph.add_node(pt)
    add_proximity_connections(inflated_graph)
    graph = inflated_graph



a.put(graph)
# ---------- end decodes ----------

pt_3 = Point(evalsrf.Point)

# ---- group: proximity removal
decodes_2 = DecodesPythonScript(graph_in=decodes.a, tol=number_slider)  # -> console, a
# ---------- decodes_2: Python ----------
gph = copy.deepcopy(graph_in)

"""
Point Proximity Cleanup
Ensures that Points are not too close together - if any node in the graph is too close to another node it is removed.
"""
for src,tar in gph.node_pairs:
    # if the distance to a target node is below the tolerance:
    if src.dist(tar)<tol:
        # remove all traces of the target node
        if tar in gph.edges and node in gph.edges:
            for node in gph.edges[tar]: gph.edges[node].remove(tar)
            del gph.edges[tar]
        gph.nodes.discard(tar)
                
                
a.put(gph)
# ---------- end decodes_2 ----------

# ---- group: angle removal
decodes_3 = DecodesPythonScript(graph_in=decodes_2.a)  # -> console, a
# ---------- decodes_3: Python ----------
gph = copy.deepcopy(graph_in)

"""
Angle Cleanup
Ensures that connected edges are not nearly parallel - if any connection in the graph is too similar to another connection, it is removed.
"""
# a minimum ratio of edge lengths
allowable_ratio = 1.6
#returns node pairs forming a triangle with a given node
def forms_triangle_with(g,src):
    ret = []
    for tar in g.edges[src]:
        # intersection of src neighbors and target neighbors sets
        mut_nbrs = set(g.edges[src]) & set(g.edges[tar])
        mut_nbrs.discard(src) 
        if len(mut_nbrs) > 0: ret.extend([(tar,mut) for mut in mut_nbrs ])
    return ret

    
for src in gph.nodes:
    # for each trio of nodes 
    for n1,n2 in forms_triangle_with(gph,src):
        # if one connection is similar in length to two others
        if (src.dist(n1)+ src.dist(n2))/n1.dist(n2) < allowable_ratio:
            # remove it
            if n2 in gph.edges[n1]: gph.edges[n1].remove(n2)
            if n1 in gph.edges[n2]: gph.edges[n2].remove(n1)

a.put(gph)
# ---------- end decodes_3 ----------

# ---- group: quad removal
decodes_4 = DecodesPythonScript(graph_in=decodes_3.a)  # -> console, a
# ---------- decodes_4: Python ----------
gph = copy.deepcopy(graph_in)

"""
Quad and Cross Detection
Given a graph (g) and a starting node (n0), searches chains of connected nodes that form a "quad", which is understood as four connections that form a loop. Optionally, we may search for "crosses", which are understood as quads that have connections across both diagonals.
[pseudo]
"""
def forms_quad_with(g,src,allow_diagonal=False):
    ret = []
    for n1 in g.edges[src]:
        # for each valid 1st and 2nd degree connection
        for n2 in set(g.edges[n1]) - set([src]):
            # if searching for quads
            if not allow_diagonal:
                # check each 3rd degree connection and return quads if found
                pass
                if src in g.edges[n2] or n2 in g.edges[src]:  continue # diagonal found
                for n3 in set(g.edges[n2]) - set([n1,src]):
                    if n3 in g.edges[n1] or n1 in g.edges[n3]:  continue # diagonal found
                    if src in g.edges[n3]:
                        ret.append([n1,n2,n3])
            # if searching for crosses
            else:
                # check each 3rd degree connection and return crosses if found
                if src in g.edges[n2] or n2 in g.edges[src]: # diagonal found
                    for n3 in set(g.edges[n2]) - set([n1,src]):
                        if n3 in g.edges[n1] or n1 in g.edges[n3]: # diagonal found
                            if src in g.edges[n3]:
                                ret.append([n1,n2,n3])
    return ret

"""
Quad Removal
Ensures triangulation - removes any quad connections found in the graph by creating diagonals along its shorter edge.
"""
for src in gph.nodes.copy():
    # for each quartet of nodes
    for n1,n2,n3 in forms_quad_with(gph,src):
        # create connection across the smaller diag
        if src.distance2(n2) < n1.distance2(n3): gph.add_edge(src,n2)
        else: gph.add_edge(n1,n3)



a.put(gph)
# ---------- end decodes_4 ----------

# ---- group: cross removal
decodes_5 = DecodesPythonScript(graph_in=decodes_4.a)  # -> console, a
# ---------- decodes_5: Python ----------
gph = copy.deepcopy(graph_in)


"""
Quad and Cross Detection
Given a graph (g) and a starting node (n0), searches chains of connected nodes that form a "quad", which is understood as four connections that form a loop. Optionally, we may search for "crosses", which are understood as quads that have connections across both diagonals.
[noprint]
"""
def forms_quad_with(g,src,allow_diagonal=False):
    ret = []
    for n1 in g.edges[src]:
        # for each valid 1st and 2nd degree connection
        for n2 in set(g.edges[n1]) - set([src]):
            # if searching for quads
            if not allow_diagonal:
                # check each 3rd degree connection and return quads if found
                pass
                if src in g.edges[n2] or n2 in g.edges[src]:  continue # diagonal found
                for n3 in set(g.edges[n2]) - set([n1,src]):
                    if n3 in g.edges[n1] or n1 in g.edges[n3]:  continue # diagonal found
                    if src in g.edges[n3]:
                        ret.append([n1,n2,n3])
            # if searching for crosses
            else:
                # check each 3rd degree connection and return crosses if found
                if src in g.edges[n2] or n2 in g.edges[src]: # diagonal found
                    for n3 in set(g.edges[n2]) - set([n1,src]):
                        if n3 in g.edges[n1] or n1 in g.edges[n3]: # diagonal found
                            if src in g.edges[n3]:
                                ret.append([n1,n2,n3])
    return ret

"""
Cross Removal
Ensures clean overlaps by removing any overlapping or crossing connections
"""
for n0 in gph.nodes:
    chns = forms_quad_with(gph,n0, False)
    # for each chain found:
    for chn in chns:
        # find the longest diagonal connection and remove
        chn.sort(key = lambda pt : n0.distance2(pt))
        if chn[-1] in gph.edges[n0]: gph.edges[n0].remove(chn[-1])

a.put(gph)
# ---------- end decodes_5 ----------

# ----
# c
decodes_6 = DecodesPythonScript()  # -> console, a
# ---------- decodes_6: Python ----------
'''
4.02.L02c
Creates an extension of the Triangle Class that makes tileable Triangles. 

members:
pt_a(Point) First point of the Triangle Tile
pt_b(Point) Second point of the Triangle Tile
pt_c(Point) Third point of the Triangle Tile
type(Integer) Type of Tile

methods:
is_neighbor(TriTile, Integer) Determines if another TriTile is adjacent to it.
flipped(None) Flips the direction of the Triangle.
match(TriTile) Matches one of its sides to another Triangle side.
perp_vec(Integer) Returns the perpendicular Vector to a side of the Triangle.
inscribe_curves([Curve]) Returns the tile curves based on tile type.
'''

"""
TriTile Class
Extends the Tri Class to include functionality for tiling triangles. Each TriTile stores its 'type', which determines the topology of curves that are drawn on it, and a list of the TriTiles adjacent to it.
"""
class TriTile(Tri):
    
    def __init__(self, pt_a, pt_b, pt_c, type=0):
        super(TriTile, self).__init__(pt_a, pt_b, pt_c)
        self.type = type
        self.neighbors = []
        
        self.p_tol = 0.6
    """
    [noprint]
    """
    def __eq__(self, other):
        return self.shares_pts(other,3)
    
    """
    Shares Points Method
    Determines if a given TriTile is adjacent to this TriTile by counting the number of shared points
    """
    def shares_pts(self, other, val=2):
        return len([pt for pt in other.pts if pt in self.pts]) >= val
    
    
    """
    Perpendicular Vector
    Returns a vector perpendicular to an edge of this TriTile, and also perpendicular to the plane that bisects this TriTile and a neighboring TriTile (if present).
    """
    def perp_vec(self,edge_idx,neighbor=False):
        edge_vec = self.edge_bisector(edge_idx).vec.normalized()
        
        # determine if the given edge abuts a neighboring tile
        for nei_tri in self.neighbors:
            for nei_edge in nei_tri.edges:
                if all([pt in nei_edge.pts for pt in self.edge(edge_idx).pts]): 
                    # looks like we found a neighbor that shares an edge
                    nei_vec = nei_edge.vec.cross(nei_tri.plane.normal).normalized()
                    # return an 'averaged' vector
                    return edge_vec + nei_vec
        # no neighbor found, return vector in plane with TriTile
        return edge_vec
            
    """
    Inscribe Curves
    Returns the curve pattern representation of the TriTile
    """
    
    def inscribe_curves(self):
        # get the perpendicular vector to each side
        v0,v1,v2 = [self.perp_vec(i).normalized(self.p_tol) for i in range(3)]
        # define needed interpolation points
        p0, p1, p3, p4, p5, p6 = self.interp_pts()
        
        # create the appropriate curves for each tile type
        cva = Curve.bezier([p0, p0+v0, self.centroid, p5+v2, p5])
        if self.type == 1:
            cvb = Curve.bezier([p3, p3+v1, self.centroid, p4+v1, p4])
            cvc = Curve.bezier([p6, p6+v2, self.centroid, p1+v0, p1])
        else:
            cvb = Curve.bezier([p3, p3+v1, p5, self.centroid, p1+v0, p1])
            cvc = Curve.bezier([p6, p0+v0, cva.eval(0.5)])
        return cva, cvb, cvc
    
    def interp_pts(self):
        pts = []
        for a,b in ((0,1),(1,2),(2,0)):
            for t in [1/3,2/3]:
                pts.append(Point.interpolate(self.pts[a], self.pts[b], t))
        return pts
    
    
    """
    tells Grasshopper not to convert a TriTile into a Grasshopper triangle when moving between components
    [noprint]
    """
    @property
    def do_translate(self):
        return False
            
    """
    Flipped Constructor
    Functional, but not required: Returns a new TriTile with Points ordered in the opposite direction of this TriTile
    [noprint]
    """
    def flipped(self):
        tri = TriTile(self.pts[0], self.pts[2], self.pts[1], self.type)
        tri.neighbors = self.neighbors
        return tri
    
    """
    Match Method
    Functional, but not required: Matches one of its sides to another Triangle side.
    [noprint]
    """
    def match(self, other):
        #for pt in [pt in self.pts if pt not in other.pts]:
        #    print pt
        npts = []
        for pt in self.pts:
            if pt not in other.pts:
                # find the point not in the other triangle
                pt_a = pt
            # and put the other two in a list
            else: npts.append(pt)
        # make a new tile with a modified point order
        tri = TriTile(pt_a, npts[0], npts[1], self.type)
        # assign it the neighbors
        tri.neighbors = self.neighbors
        return tri


a.put(TriTile)
# ---------- end decodes_6 ----------

# ---- group: tri creation
# d
decodes_7 = DecodesPythonScript(gph=decodes_5.a, TriTile=decodes_6.a)  # -> console, flatten(a)
# ---------- decodes_7: Python ----------
"""
TriTile Creation
Given a graph of points and connections, creates Tritiles wherever possible.
"""
# initialize a dictionary to hold tiles
dict = {}

# for every node in the graph:
for n0 in gph.nodes:
    # initialize a list indexed to this node in our dict
    dict[n0] = []
    # for every possible pair of connections to this node:
    for n1 in gph.edges[n0]:
        for n2 in set(gph.edges[n0]) - set([n1]):
            # if they are connected to each other:
            if n2 in gph.edges[n1] or n1 in gph.edges[n2]:
                # create a TriTile
                tri = TriTile(n0,n1,n2)
                # store it if it doesn't already exist
                if not any(pt in dict and tri in dict[pt] for pt in tri.pts):
                    dict[n0].append(tri)



##############################################
vals = dict.values()
#print vals
a.put(dict.values())
# ---------- end decodes_7 ----------

# ---- group: view graph
decodes_8 = DecodesPythonScript(gph=decodes_5.a)  # -> console, a, b; disabled
# ---------- decodes_8: Python ----------
"""
[noprint]
"""
print gph

def to_segs(sgraph):
    for spt, epts in sgraph.edges.items():
            a.put([Segment(spt, ept) for ept in epts])
            #a.put([Segment(spt,spt+(Vec(spt,ept)*0.8)) for ept in epts])
        
to_segs(gph)
# ---------- end decodes_8 ----------

# ---- group: neighbor creation
decodes_9 = DecodesPythonScript(tris=decodes_7.a)  # -> console, a; inputs tris: list
# ---------- decodes_9: Python ----------
tris = copy.deepcopy(tris)
##############################################


"""
TriTile neighorhood creation
Given a list of TriTiles, computes all adjacencies and stores references to neighbors
"""

for tri in tris:
    for other in set(tris) - set([tri]):
        if tri.shares_pts(other,1) : tri.neighbors.append(other)
            



##############################################
a.put(tris)
# ---------- end decodes_9 ----------

# ----
line = Line(decodes_8.a)  # disabled
pt_4 = Point(decodes_8.b)  # disabled

# ---- group: tiling
# e
decodes_10 = DecodesPythonScript(tris=decodes_9.a)  # -> console, a, b, c; inputs tris: list
# ---------- decodes_10: Python ----------
tris = copy.deepcopy(tris)
###################################


"""
TriTile Type Assignment and Visualization
Assigns a type to each tile in order for matching to occur correctly
"""
# for every TriTile
for tri in tris:
    # attempt to make a type 2 out of this tile
    if tri.type == 0 and len(tri.neighbors) >= 3:
        # if none of the neighbors are of type 2
        if not 2 in [nei.type for nei in tri.neighbors]:
            # see if we can make a type 2 out of one of the neighbors
            for nei in tri.neighbors:
                if nei.shares_pts(tri, 2) and nei.type !=2:
                    # if this neighbor doesn't already have a type 2 neighbor:
                    if not 2 in [other.type for other in nei.neighbors]:
                        # we've found a valid type 2 pair!
                        tri.type, nei.type = 2,2
                        break
    # if this is a type 2 tile, orient to match its partner:
    if tri.type == 2:
        # find the type two parnter of this tile
        nei = next(n for n in tri.neighbors if n.type==2)
        # rotate and flip to match properly
        if tri.pb not in nei.pts: tri.rotate()
        if tri.pc not in nei.pts: tri.flip(keep_b=True)
        if tri.pb != nei.pb : tri.flip(keep_a=True)
    # if this tile was not made into a type 2
    else: 
        # make it a type 1
        tri.type = 1

crvs = [tri.inscribe_curves() for tri in tris]

###################################
for group in crvs:
    a.put([crv.surrogate for crv in group])

for tri in tris:
    b.put(tri.to_pgon())
    if tri.type == 2:
        c.put(tri.to_msh())
# ---------- end decodes_10 ----------

# ----
geo_2 = Geometry(decodes_10.c)
geo_3 = Geometry(decodes_10.b)
geo_4 = Geometry(decodes_10.a)
