# Grasshopper definition 4.02.L04_inflationTiling.ghx (Grasshopper 0.9.75)
# plug-ins: Decodes Python Interpreter

# ---- group: Pinwheel Tile Class
# a
decodes = DecodesPythonScript()  # -> console, a
# ---------- decodes: Python ----------
'''
4.01.L04a
Create a Pinwheel tiling based on a set of ideal points, and a set of transformations of the original points.

members:
xf (Xform) A transformation for the inflation of the tiling.

methods:
base_pts ([Point]) Get the base points for a tile.
_cs_from_base_pts (CS) Returns a CS oriented to an idealized tile's base points. 
to_mesh (Mesh) Returns a mesh representation of the tile.
_lineage_to_colors (Mesh) Assign color to the tiles based on their lineage.
centroid (Point) Get the centroid of a Mesh.
inflate ([PinwheelTile]) Subdivide Tiles.

'''


"""
# according to Radin, the pinwheel tiling contains one prototyle 
# a triangle with the following edge lenghts: 1, 2, sqrt(5)
# (http://www.ma.utexas.edu/users/radin/papers/pinwheel.pdf)
# (http://www.michaelwhittaker.ca/fractalpinwheel.pdf)
# some nice variation (color) here: http://tilings.math.uni-bielefeld.de/substitution_rules/pinwheel_1_2_0
[noprint]
"""

"""
A class that represents a Pinwheel tiling prototyle, and provides methods for creating a Pinwheel tiling via inflation.
The constructor of this class requires an Xform that describes the world-space location of the instance of the tile to be constructed, and optionally, a 'lineage' that is used to track the history of each tile inflation.
"""

#a constant describing a scale factor of each inflation
XF_SCALE = Xform.scale(1/math.sqrt(5))

class PinwheelTile(object):
    def __init__(self,xf=Xform(), lineage="RT"):
        self.lineage = lineage
        self.xf = xf

        # the idealized base Points for all pinwheel tiles
        self._base_pts= [\
            Point(),\
            Point(2.0, 0.0),\
            Point(0.0, 1.0),\
            Point(0.2, 0.4),\
            Point(1.2, 0.4),\
            Point(0.4, 0.8),\
            Point(1.0, 0.0),\
        ]

        """
        [noprint]
        """
        # sets base colors for pinwheeel tiles
        self._colors=[\
            Color(0.41,0.34,0.13),\
            Color(0.76,0.63,0.24),\
            Color(0.11,0.22,0.41),\
            Color(0.25,0.43,0.71),\
            Color(1.00,0.25,0.25),\
        ]
                      
    """
    Returns the base points for this tile in "world" coordinates, 
    rather than the "local" coordinates that are stored in the self._base_pts attribute
    """
    @property
    def base_pts(self):
        #transform each base point by the xform of this tile
        return [p*self.xf for p in self._base_pts]
        
    """
    A private method that, given three indices selecting from the list of this tile's base_pts, returns a CS oriented to an idealized tile's base points. Multiply the result by this_tile.xf and you'll get a coordinate system oriented to the position of this tile in the world. This method is used during the inflation process to position child tiles relative to their parent's base_pts.
    """
    def _cs_from_base_pts(self,pt_o=0,pt_x=1,pt_y=2):
        #select the CS origin from our list of base_pts
        pt_0 = self._base_pts[pt_o]
        #construct vectors describing the desired x and y-axes
        vec_x = Vec(pt_0,self._base_pts[pt_x])
        vec_y = Vec(pt_0,self._base_pts[pt_y])
        #construct and return the desired CS
        return CS(pt_0, vec_x, vec_y)
     
    """
    Inflates this PinwheelTile and returns a list of smaller tiles.
    """
    def inflate(self):
        #a transformation from this tile to the 1st child tile
        xf_pos = self._cs_from_base_pts(3,6,5).xform
        #create a scaled child tile at the designated position 
        tile0 = PinwheelTile(self.xf * xf_pos * XF_SCALE,self.lineage+",0")
                                  
        #create a child tile from base_pts [4,5,6]
        xf_pos = self._cs_from_base_pts(4,5,6).xform
        tile1 = PinwheelTile(self.xf * xf_pos * XF_SCALE,self.lineage+",1")
        #create a child tile from base_pts [3,6,0]
        xf_pos = self._cs_from_base_pts(3,6,0).xform
        tile2 = PinwheelTile(self.xf * xf_pos * XF_SCALE,self.lineage+",2")
        #create a child tile from base_pts [5,0,2]
        xf_pos = self._cs_from_base_pts(5,0,2).xform 
        tile3 = PinwheelTile(self.xf * xf_pos * XF_SCALE,self.lineage+",3")
        #create a child tile from base_pts [4,1,6]
        xf_pos = self._cs_from_base_pts(4,1,6).xform
        tile4 = PinwheelTile(self.xf * xf_pos * XF_SCALE,self.lineage+",4")
        
        #return all child tiles
        return [tile0,tile1,tile2,tile3,tile4]
        
    """
    Assorted methods, including one for creating a mesh from this PinwheelTile's vertices.
    [noprint]
    """   
    
    def to_pgon(self):
        pts = [self._base_pts[0],self._base_pts[1],self._base_pts[2]]
        return PGon([pt * self.xf for pt in pts])
    
    # create a mesh from the vertices of a tile
    def to_mesh(self, color=None, pc_inheritance=0.5):
        # if the tile is not colored yet:
        if color is None :
            # get a Color based on its lineage
            clr_list = self._lineage_to_colors()
            try:
                clr_list.reverse()
                color = clr_list[0]
                # for every Color of the list: 
                for parent_color in clr_list[1:]:
                    # get and interpolated value for them 
                    color = Color.interpolate(color,parent_color,pc_inheritance)
            except:
                color = clr_list
                
        # draw a Mesh with the Points
        msh = Mesh()
        msh.append(self._base_pts[0] * self.xf)
        msh.append(self._base_pts[1] * self.xf)
        msh.append(self._base_pts[2] * self.xf)
        msh.add_face(0,1,2)
        msh.set_name(self.lineage)
        msh.set_color(color)
        return msh
    
    # returns the centroid of this tile
    @property
    def centroid(self): 
        return Point.centroid(self.base_pts)
    
    def _lineage_to_colors(self):
        lin = self.lineage.split(',')
        if len(lin)==0 : return Color()
        return [self._colors[int(str)] for str in lin[1:]]
    

        
a.put(PinwheelTile)
# ---------- end decodes ----------

# ---- group: Amman Tile Class
# c
decodes_2 = DecodesPythonScript()  # -> console, a
# ---------- decodes_2: Python ----------
'''
4.01.L04c
Create an Ammann tiling class based on a set of ideal points, and a set of transformations of the original points.

members:
xf (Xform) A transformation for the inflation of the tiling.

methods:
base_pts ([Point]) Get the base points for a tile.
_cs_from_base_pts (CS) Returns a CS oriented to an idealized tile's base points. 
to_pgon (Mesh) Returns a polygon representation of the tile.
inflate ([PinwheelTile]) Subdivide Tiles.

'''

"""
Ammann A3
http://tilings.math.uni-bielefeld.de/substitution_rules/ammann_a3
[noprint]
"""
    
"""
A Class containing methods to create Ammann tiles. 
"""

# a constant for scaling between generations
TAU = (1 + math.sqrt(5)) / 2   
TAU_2 = TAU**2
TAU_3 = TAU**3

class AmmannA3Tile(object):
    
    def __init__(self,xf=Xform(), lineage="RT",scale=None):
        # assign lineage to object
        self.lineage = lineage
        # assign a Xform to the object
        self.xf = xf
        #an Xform with which to scale at each inflation
        self._xf_scale = Xform.scale(1/TAU) #0.618033
        #the current scale of this tile
        self.scale = scale
    
    """
    A private method that, given three indices selecting from the list of this tile's base_pts, returns a CS oriented to an idealized tile's base points. 
    Multiply the result by this_tile.xf and you'll get a coordinate system oriented to the position of this tile in the world.
    This method is used during the inflation process to position child tiles relative to their parent's base_pts.
    """
    def _cs_from_base_pts(self,pt_o=0,pt_x=1,pt_y=2):
        #pt_0 refers to the index of the origin of our CS
        pt_0 = self._base_pts[pt_o]
        #pt_x refers to the index a point on the x-axis
        pt_x = self._base_pts[pt_x]-self._base_pts[pt_o]
        #pt_y refers to the index a point on the y-axis
        pt_y = self._base_pts[pt_y]-self._base_pts[pt_o]
        return CS(pt_0, pt_x, pt_y)
    
    """
    [noprint]
    """
    # world base Points for this tile
    @property
    def base_pts(self):
        return [p*self.xf for p in self._base_pts]
        
    # draw a PGon from the Points
    def to_pgon(self):
        pg = PGon(self.base_pts[:self.boundary_base_pt_cnt])
        pg.name = self.lineage
        return pg    
        
        
"""
A subclass that extends AmmanA3Tile, and adds methods specific to an Ammann tile A. 
"""
class AmmannA3TileA(AmmannA3Tile):
    # the idealized base Points for all Tiles of type A
    @property
    def _base_pts(self):
        return [ \
            Point(0.0, 0.0),\
            Point(TAU_3, 0.0),\
            Point(TAU_3, TAU_2),\
            Point(TAU_3-TAU_2, TAU_2),\
            Point(TAU_3-TAU_2, TAU),\
            Point(0, TAU)\
            ]

    """
    Inflates this tile and returns a list of smaller tiles.
    """        
    def inflate(self):
        #a transformation from this tile to the 1st child tile
        xf_pos = self._cs_from_base_pts(0,1,5).xform
        #create a scaled TileB at the designated position 
        b0=AmmannA3TileB(self.xf * xf_pos * self._xf_scale,self.lineage+",b0")
        
        #a transformation from this tile to the 2nd child tile
        xf_pos = self._cs_from_base_pts(1,2,0).xform
        #create a scaled TileA at the designated position 
        a0=AmmannA3TileA(self.xf * xf_pos * self._xf_scale,self.lineage+",a0")
        
        #return all child tiles
        return [b0,a0]
        
    """
    [noprint]
    """
    @property
    def boundary_base_pt_cnt(self): return 6

"""
A subclass that extends AmmanA3Tile, and adds methods specific to an Ammann tile B.
[pseudo]
"""
class AmmannA3TileB(AmmannA3Tile):
    #returns the ideal base points specific to Amman B Tiles
    @property
    def _base_pts(self):
        #explicitly define each base point in sequence, and return ordered list
        return [ \
            Point(0.0, 0.0),\
            Point(TAU_2-TAU,0),\
            Point(2*TAU_2-(TAU+1), 0.0),\
            Point(2*TAU_2, 0.0),\
            Point(2*(TAU_2), TAU),\
            Point((2*(TAU_2))-1, TAU),\
            Point((2*(TAU_2))-1, TAU+TAU_2),\
            Point((2*(TAU_2))-1-TAU, TAU+TAU_2),\
            Point((2*(TAU_2))-1-TAU, TAU_2),\
            Point(TAU_2-TAU, TAU_2),\
            Point(0, TAU_2),\
            Point(0,TAU),\
            Point(TAU_2+TAU-1, TAU_2)\
            ]
            
    """
    Inflates this tile and returns a list of smaller tiles.
    [pseudo]
    """       
    def inflate(self):
        #create a child TileA from base_pts [10,0,9]
        xf_pos = self._cs_from_base_pts(10,0,9).xform
        a0 = AmmannA3TileA(self.xf * xf_pos * self._xf_scale,self.lineage+",a0")
        #create a child TileA from base_pts [2,3,8]
        xf_pos = self._cs_from_base_pts(2,3,8).xform
        a1 = AmmannA3TileA(self.xf * xf_pos * self._xf_scale,self.lineage+",a1")
         #create a child TileA from base_pts [5,6,11]
        xf_pos = self._cs_from_base_pts(5,6,11).xform
        a2 = AmmannA3TileA(self.xf * xf_pos * self._xf_scale,self.lineage+",a2")
         #create a child TileC from base_pts [12,10,1]
        xf_pos = self._cs_from_base_pts(12,10,1).xform
        c0 = AmmannA3TileC(self.xf * xf_pos * self._xf_scale,self.lineage+",c0")
        
        #return all child tiles
        return [a0,a1,a2,c0]
        
    """
    [noprint]
    """
    @property
    def boundary_base_pt_cnt(self): return 11

"""
A subclass that extends AmmanA3Tile, and adds methods specific to an Ammann tile C.
[pseudo]
"""
class AmmannA3TileC(AmmannA3Tile):
    
    #returns the ideal base points specific to Amman C Tiles
    @property
    def _base_pts(self):
        #explicitly define each base point in sequence, and return ordered list
        return [ \
            Point(1+TAU_2, 0.0),\
            Point(1+TAU_2, TAU),\
            Point((1+TAU_2)-1, TAU),\
            Point((1+TAU_2)-1, TAU+TAU_2),\
            Point((1+TAU_2)-1-TAU, TAU+TAU_2),\
            Point((1+TAU_2)-1-TAU, TAU+1),\
            Point(1-TAU, TAU+1),\
            Point(1-TAU, TAU),\
            Point(0, TAU),\
            Point(0.0, 0.0),\
            Point((1+TAU_2)-(TAU+1),0),\
            Point((1+TAU_2)-(TAU+1)+(TAU-1),TAU+1)\
                ]
                
    """
    Inflates this tile and returns a list of smaller tiles.
    [pseudo]
    """       
    def inflate(self):
        #create a child TileA from base_pts [10,0,5]
        xf_pos = self._cs_from_base_pts(10,0,5).xform
        a0 = AmmannA3TileA(self.xf * xf_pos * self._xf_scale,self.lineage+",a0")
        #create a child TileA from base_pts [2,3,7]
        xf_pos = self._cs_from_base_pts(2,3,7).xform
        a1 = AmmannA3TileA(self.xf * xf_pos * self._xf_scale,self.lineage+",a1")
        #create a child TileC from base_pts [11,5,10]
        xf_pos = self._cs_from_base_pts(11,5,10).xform
        c0 = AmmannA3TileC(self.xf * xf_pos * self._xf_scale,self.lineage+",c0")
        
        #return all child tiles
        return [a0,a1,c0]
        
    """
    [noprint]
    """
    @property
    def boundary_base_pt_cnt(self): return 10
    



a.put(AmmannA3TileC)
# ---------- end decodes_2 ----------

# ---- group: Inflate Tiles
# d
decodes_3 = DecodesPythonScript(AmmannA3TileC=decodes_2.a, iter=Slider(4, range=0..10))  # -> console, a; inputs iter: Int32
# ---------- decodes_3: Python ----------
'''
4.01.L04d
Create a Ammann tile object and inflate the tile.

required:
tileC (PinwheelTile) Ammann Tile C Class.
iter (int) Number of recursions.

result:
ret ([PGon]) Ammann tiles.
'''

""" 
Inflate an Ammann tile recursively.
"""
# create a TileC and inflate it once
tiles = AmmannA3TileC().inflate()

# for every desired generation of Ammann tiles
for n in range(iter):
    # create a container to hold inflated tiles
    nxt_tiles = []
    #inflate each tile in the current generation, and store
    for tile in tiles: nxt_tiles.extend(tile.inflate())
    # draw the inflated tiles
    a.put([t.to_pgon() for t in nxt_tiles])
    # set things up for the next generation of inflation
    tiles = nxt_tiles
# ---------- end decodes_3 ----------
geo = Geometry(decodes_3.a)

# b
decodes_4 = DecodesPythonScript(PinwheelTile=decodes.a, iter=Slider(3, range=0..4))  # -> console, a; inputs iter: Int32
# ---------- decodes_4: Python ----------
'''
4.01.L04b
Create a Pinwheeltile object and inflate the tile.

required:
pwtile (PinwheelTile) Pinwheel Class.
iter (int) Number of recursions.

result:
ret ([mesh]) Pinwheel tiles.
'''

""" 
Inflate a pinwheel tile recursively.
"""

# Create a PinwheelTile and inflate it
tiles = PinwheelTile().inflate()

# If the number of iterations is to high, only iterate 4 times
if iter > 4: iter = 4

# for every generation of pinwheel tiles
for n in range(iter):
    nxt_tiles = []
    # for every tile in every generation, inflate the tile
    for tile in tiles:
        nxt_tiles.extend(tile.inflate())
    # set the current tile generation to the inflated tiles
    tiles = nxt_tiles


# Draw meshes from the points
for tile in tiles:
    pg = tile.to_pgon()
    a.put(pg)
# ---------- end decodes_4 ----------
geo_2 = Geometry(decodes_4.a)
