# Grasshopper definition 4.02.L06_LSystems.ghx (Grasshopper 0.9.75)
# plug-ins: Decodes Python Interpreter

# ----
# a
# CONTROLS: F  :  STEP FORWARD
# -  :  TURN RIGHT
# +  :  TURN LEFT
# { :  ROLL LEFT
# }  :  ROLL RIGHT
# ^  :  PITCH UP
# &  :  PITCH DOWN
# [  :  START BRANCH
# ]  :  END BRANCH
decodes = DecodesPythonScript()  # -> console, a
# ---------- decodes: Python ----------
'''
4.02.L06a
This creates an LEngine class. This class provides methods to iteratively update generations of the rule string based on the initial rule string.

members:
axiom (str) Initial rule string.
rules ([[str, str]]) A set of rules as tuples that specifies how each character is replaced.

methods:
add_rule (None) Formats input string and adds it as a rule.
apply_rules (str) Returns the replacement for the given character.
step (None) Applies character replacement to strings based on rules.
cur_gen ([str]) Returns the last generation of applied strings of rules.
clear (None) Removes all rules and applied strings of rules.
'''

"""
The LEngine class takes an initial string called an axiom and provides methods to iteratively produce new generations of strings based on transformations defined by a set of rules.
"""

class LEngine(object):

    def __init__(self,axiom):
        self.axiom = axiom
        self.rules = []
        self.clear()
    
    """
    Add Rule Method
    Adds a rule to this LEngine.  Rules may be defined as single strings separated by "->" or as a tuple of two strings
    """
    def add_rule(self,rulething):
        rule = [str.strip() for str in rulething.split("->")]
        self.rules.append(rule)
    
    """
    Adds a rule to this LEngine.  Rules may be defined as single strings separated by "->" or as a tuple of two strings.
    """
    def add_rule(self,rulething):
        # try treating the rule as a single separated string:
        try:
            rule = rulething.strip()
            # attempt to split the rule at the arrow
            rule = [str.strip() for str in rulething.split("->")]
        except:
            # try treating the rule as a tuple:
            try:
                rule = rulething[0],rulething[1]
            except:
                # and if neither works, raise an error
                raise TypeError("oh snap, that's not a rule")
        # if it is a valid rule, add it to the list of rules
        self.rules.append(rule)

    """
    Returns the replacement string for the specified character based on the rules.  If no rules apply, returns the original character.
    """
    # returns the replacement for the given character
    def apply_rules(self, char):
        # for each rule in the rule set:
        for rule in self.rules:
            # if the character matches the first half of the rule:
            if char == rule[0]:
                # then return the second half of the rule
                return rule[1]
                break
        # if none match, return the original character
        return str(char)
    
    """
    Produces a new string based on the transformations defined by the set of rules.
    """
    def step(self):
        nxt_gen = ""
        # for every character in the current string:
        for chr in self.cur_gen:
            # check if there is a rule that applies to it and replace
            nxt_gen += self.apply_rules(chr)
        self.hist.append(nxt_gen)

    """
    [noprint]
    """
    # returns the last generation of applied strings of rules
    @property
    def cur_gen(self):
        return self.hist[-1]
    
    # removes all rules and applied strings of rules
    def clear(self):
        self.hist = [self.axiom]
        self.rules = []

a.put(LEngine)
# ---------- end decodes ----------

axiom = Panel("X")
_3d_tree = Panel("""X -> F-[[X]^XB]+F[&FXA]-X}
F -> F&FC{{
A -> FX
B -> CA
C -> X""")
_2d_tree = Panel("""X -> F-[[X]+X]+F[+FX]-X
F -> FF""")
dragon_curve = Panel("""X -> X+YF+
Y -> -FX-Y""")

# ----
# b
decodes_2 = DecodesPythonScript()  # -> console, a
# ---------- decodes_2: Python ----------
'''
Creates an LTurtle class that takes a string and interprets each character and its corresponding turtle command, then returns a series of lines corresponding to the movement of the turtle.

members:
inst (str) A string whose characters direct the turtle's movements.
pts ([Point]) A list of saved points from which to branch.
css ([CS]) A list of saved coordinate systems from which to branch.
angle (float) Stores the angle for the turtle's rotation (set to pi/4 radians).
step_size (float) Stores the step size for the turtle's movement (set to 1.0).

methods:
execute ([Segment]) Interprets the instructing string and moves the turtle accordingly.
do_xform (None) Applies the transformation to the turtle's coordinate system.
push (None) 
pop (None)
'''

"""
LTurtle Class
Defines a 'turtle' agent that is capable of moving about in space in accordance with an interpretation of an instruction string
"""

class LTurtle(object):
    
    def __init__(self,instructions):
        self._pts = [Point()]
        self._css = [CS()]
        self.angle = math.pi/4
        self.step_size = 1.0
        self.cur_depth = 0
        # resulting line segments
        self.segs = []
        # execute given instructions
        self.execute(instructions)
        
        

    """
    Push and Pop Methods
    Methods that allow the turtle to branch
    """
    # adds the current point and coordinate system to lists
    def push(self):
        self._pts.append(self.pos)
        self._css.append(self.frame)
        self.cur_depth += 1
        
    # removes the last point and coordinate system from lists
    def pop(self):
        self._pts = self._pts[:-1]
        self._css = self._css[:-1]
        self.cur_depth -= 1
        
    @property
    def frame(self): 
        return self._css[-1]
    
    @property
    def pos(self): 
        return self._pts[-1]
    
    """
    [noprint]
    """
    @frame.setter
    def frame(self,value): 
        self._css[-1] = value
    
    @pos.setter
    def pos(self,value): 
        self._pts[-1] = value

    """
    Go Method
    Interprets the instruction string, alters this LTurtle's position and orientation accordingly, and updates this LTurtle's history of positions accordingly.
    """
    def execute(self,inst):
        # while the length of the string is not 0:
        while len(inst)>0:
            chr = inst[0]
            
            # start a new branch if the character is '['
            if chr == '[': self.push()
            # go back to the start of this branch if the character is ']'
            elif chr == ']': self.pop() 
            
            # yaw right
            elif chr == '-': self.rotate_frame("z_axis")
            # yaw left
            elif chr == '+': self.rotate_frame("z_axis",-1)
            # pitch up
            elif chr == '^': self.rotate_frame("x_axis",-1)
            # pitch down
            elif chr == '&': self.rotate_frame("x_axis")
            # roll right
            elif chr == '}': self.rotate_frame("y_axis")
            # roll left
            elif chr == '{': self.rotate_frame("y_axis",-1)
            
            # step forward :
            elif chr == 'F':
                # draw a segment along the y axis of the current frame
                nxt_pt = self.pos + (self.frame.y_axis * self.step_size)
                seg = Segment(self.pos,nxt_pt)
                seg.depth = self.cur_depth
                self.segs.append(seg)
                self.pos = nxt_pt
            
            # remove this character and keep going 
            inst = inst[1:]

    """
    Rotate Frame
    Applies a rotational transformation to the frame of this LTurtle
    """
    def rotate_frame(self,axis,angle_mult=1.0):
        if axis == "x_axis" : axis = self.frame.x_axis
        elif axis == "y_axis" : axis = self.frame.y_axis
        elif axis == "z_axis" : axis = self.frame.z_axis
        angle = self.angle * angle_mult
        self.frame *= Xform.rotation(axis=axis,angle=angle)
    
    


a.put (LTurtle)
# ---------- end decodes_2 ----------

wheel = ColourWheel(
    "10",
    ColourGrips_Style=40,
    ColourGrips_Grip=[4.436962877, 5.805839925, 2.899384066, 1.635223166],
    ColourGrips_Lum=[0.6370403015, 0.7952845375],
    ColourGrips_Range=[0.2617993878, 0.2617993878, 0.2617993878, 0.2617993878],
    ColourGrips_Sat=[0.7038615125, 1])

# ----
# c
decodes_3 = DecodesPythonScript(production=_3d_tree, axiom=_3d_tree, LEngine=decodes.a, LTurtle=decodes_2.a, colors=wheel)  # -> console, a, a_props; inputs production: list, colors: list
# ---------- decodes_3: Python ----------
# sets up an L System Generator
# and a set of rules
leng = LEngine(axiom)

for rule in production:
    leng.add_rule(rule)
for n in range(3): leng.step()# generations to compute

squirt = LTurtle(leng.cur_gen)


weight_ival = Interval(0.25,2.0)
max_depth = max([seg.depth for seg in squirt.segs])
if max_depth == 0: max_depth = 1
#if max_depth > 0 : clr = [Color(n/max_depth,0,0) for n in range(max_depth+1)]


for seg in squirt.segs:
    weight = Interval.remap(seg.depth,Interval(max_depth,0),weight_ival)
    seg.set_weight(weight)
    
    seg.set_color(colors[seg.depth])
    
    a.put(seg)
# ---------- end decodes_3 ----------

hardboil = DecodesHardBoil(Geometry=decodes_3.a, Properties=decodes_3.a_props)
