# Grasshopper definition 4.03.L01_regularTiling.ghx (Grasshopper 0.9.75)
# plug-ins: Decodes Python Interpreter

line = Line(Line((-22.68336319, 0.699413448, 1.437683199), (-11.73745124, 10.47811249, 0)))

# ---- group: snub square tiling - by cell
# a
decodes = DecodesPythonScript(seed_edge=line)  # -> console, a
# ---------- decodes: Python ----------
from math import *
'''
4.01.L01a
Given a "seed edge" line, create a snub square tiling pattern by cell.

required:
seed_edge (Segment) The edge from which the tiling pattern will start.

result:
ret ([RGon]) Regular Polygons arranged in a snub square pattern.
'''

"""
Defines the cell consisting of a cluster of Rgons
"""
def cluster(edge):
    # create two triangles from a given edge
    tri_a = RGon.from_edge(edge,3)
    tri_b = RGon.from_edge(edge.inverted(),3)
    # create two squares from two triangle edges
    sq_a = RGon.from_edge(tri_a.edges[0],4)
    sq_b = RGon.from_edge(tri_b.edges[1],4)
    # create two triangles from two square edges
    tri_c = RGon.from_edge(sq_a.edges[0],3)
    tri_d = RGon.from_edge(sq_a.edges[2],3)
    return [tri_a,tri_b,sq_a,sq_b,tri_c,tri_d]

"""
Defines the "x"-translation, in direction perpendicular to seed edge
"""
def xf_x():
    # set the direction of the translation vector
    vec = seed_edge.vec.cross(Vec(0,0,1))
    # set the magnitude of the translation vector
    vec = vec.normalized((1+sqrt(3))*seed_edge.length)    
    return vec

"""
Defines the "y"-translation, which shifts according to the cluster row
"""
def xf_y(is_odd):
    # first set the translation in the direction of the seed edge
    vec = seed_edge.vec
    vec = vec.normalized( 0.5 * (1 + sqrt(3))*seed_edge.length )
    # add to this vector the shift in the "x"-directon which depends on the row 
    dx = 0.5 * (1 + sqrt(3))*seed_edge.length
    if is_odd : dx *=-1
    vec += vec.cross(Vec(0,0,1)).normalized(dx)
    return vec

"""
Create and aggregate a number of clusters starting from a seed edge
"""
# make sure seed edge is 2d
seed_edge._pt.z = 0
seed_edge._vec.z = 0


# create a bin for the geometry clusters
clusters = []
for v in range(4):
    row_clusters = []
    # make sure the given edge is a segment, create a new edge with it
    edge = Segment(seed_edge.spt,seed_edge.ept)
    for u in range(4):
        # create a cluster with the edge
        new_cluster = cluster(edge)
        row_clusters.append(new_cluster)
        # translate the edge in X
        edge += xf_x()
    clusters.append(row_clusters)
    # translate the seed edge in y
    seed_edge += xf_y(v%2==0)


a.put(clusters)
# ---------- end decodes ----------

# ---- group: Truncated square tiling by lattice
# b
decodes_2 = DecodesPythonScript(u_cnt=Slider(3, range=0..10), v_cnt=Slider(5, range=0..10))  # -> console, a; inputs u_cnt: Int32, v_cnt: Int32
# ---------- decodes_2: Python ----------
'''
4.01.L01b
Given a "seed edge", create a semi-regular, truncated square tiling by lattice.

required:
u_cnt (Int) Number of clusters in U direction.
v_cnt (Int) Number of clusters in V direction.

out:
nodes ([[Segment]]) List of segments.
'''

"""
Defines a lattice of half line segments emanating from a vertex node
[noprint]
"""
def node(edge,vconfig):
    rgons = []
    #create a set of regular polygons around each vertex node in order of vertex configuration
    for n in vconfig:
        rgons.append(RGon.from_edge(edge,n))
        edge = rgons[-1].edges[0]
    # create a list of half segments from these regular polygons
    segs = [Segment(rgon.pts[0],Vec(rgon.pts[0],rgon.pts[1])/2.0) for rgon in rgons]
    return segs

"""
Setting the parameters of seed edge, vertex configuration and nodes per cluster
[pseudo]
"""
# define a 'seed' segment that will be copied across the plane
seed = Segment(Point(1,1),Vec(0,1))
# define parameters specific to Truncated square tiling
v_config = (4,8,8) 
nodes_per_clst = 4
# define the extent of the grid to tile
clst_per_row = u_cnt
sqrt2 = 2**0.5 # the width of an octogon is 1+sqrt(2)*side_length
nodes = []
for n in range(u_cnt*v_cnt*nodes_per_clst):
    #if we're moving between two clusters in a row
    if n>0 and n%nodes_per_clst==0:
        # translate the seed segment between two clusters
        seed._pt += Vec(1+sqrt2*seed.length+seed.length,0)
    #if we're moving between rows
    if n>0 and n%(nodes_per_clst*clst_per_row)==0:
        # translate the seed segment up one row
        dy = 1+sqrt2*seed.length+seed.length
        if n%(nodes_per_clst*clst_per_row*2)==0 : dx = -dy*(clst_per_row+0.5)
        else : dx = -dy*(clst_per_row-0.5)
        seed += Vec(dx,dy/2.0)
    # if we're moving within a single cluster
    if n>0:
        # translate the seed segment within a cluster
        seed = Segment(seed.ept,seed._vec.cross(Vec(0,0,1)))
    # record this node
    nodes.append(node(seed,v_config))
    
a.put(nodes)
# ---------- end decodes_2 ----------
