# Grasshopper definition 4.03.L04_torusStudies.ghx (Grasshopper 0.9.75)
# plug-ins: Decodes Python Interpreter

minor_radius = Slider(0.55, range=0.01..0.6)
major_radius = Slider(0.61, range=0.61..1)
minor_radius_2 = Slider(2.669, range=2..5)
major_radius_2 = Slider(5, range=1..10)

# ---- group: standard parametrization for torus
decodes = DecodesPythonScript(r=minor_radius, R=major_radius)  # -> console, a, b
# ---------- decodes: Python ----------
"""
Torus - standard parametrization as a surface of revolution 
    x = (R + r*cos(v))*cos(u)
    y = (R + r*cos(v))*sin(u)
    z = r*sin(v)
    domain = [0, 2*pi]x[0, 2*pi]
Will look primarily at the case of the ring torus when R > r > 0
    
"""

from math import *

def torus(u,v):
    x = (R + r*cos(v))*cos(u)
    y = (R + r*cos(v))*sin(u)
    z = r*sin(v)
    return Point(x,y,z)

a.put(torus)

b.put(Surface(torus,Interval.twopi(),Interval.twopi()).surrogate)
# ---------- end decodes ----------

# ---- group: alternate parametrization for torus
decodes_2 = DecodesPythonScript(r=minor_radius, R=major_radius)  # -> console, a, b
# ---------- decodes_2: Python ----------
"""
Alternative parametrization for the ring torus with isocurves of Villarceau circles
"""

from math import *

alpha = asin(r/R)
cos_alpha = cos(alpha)
sin_alpha = sin(alpha)

#Villarceau #1, with a dependency on the angle "psi"
def villarceau(t, psi):
    x = R*cos_alpha*cos(t)
    y = R*sin(t) + r
    z = -R*sin_alpha*cos(t)
    rot_psi = Xform.rotation(axis = Vec(0,0,1), angle = -psi)
    pt_out = Point(x,y,z)*rot_psi
    return pt_out

#Set v to the angle used in derivation of 2 V-circles.  Choose one and let
#    u traverse pts on that circle
def torus(u,v):
    cos_gamma = -r*sin(v)/(R*sin_alpha)
    if (v > 0.5*pi) and (v < 1.5*pi):
        psi_v1 = atan2(-R*sqrt(1-cos_gamma*cos_gamma) + r, R*cos_alpha*cos_gamma)
    else:
        psi_v1 = atan2(R*sqrt(1-cos_gamma*cos_gamma) + r, R*cos_alpha*cos_gamma)
    return villarceau(u, psi_v1)

a.put(torus)
surf = Surface(torus, Interval.twopi(), Interval.twopi())
surf.tol_u = 0.2
surf.tol_v = 0.2
b.put(surf.surrogate)
# ---------- end decodes_2 ----------

# ----
mesh = Mesh(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)
mesh_2 = Mesh(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)

# ---- group: sphere_invert
decodes_3 = DecodesPythonScript()  # -> console, a
# ---------- decodes_3: Python ----------
#inverts a point p with respect to a sphere centered at origin with radius r_i
def sphere_invert(p, origin, r_i):
    vec = Vec(origin,p)
    vec.length = r_i**2/vec.length
    return origin + vec

a.put(sphere_invert)
# ---------- end decodes_3 ----------

# ---- group: Alternate Parametrization
# a
decodes_4 = DecodesPythonScript(r=minor_radius_2, R=major_radius_2)  # -> console, a, b
# ---------- decodes_4: Python ----------
"""
Alternative parametrization for the ring torus with isocurves of Villarceau circles

"""

from math import *

alpha = asin(r/R)
cos_alpha = cos(alpha)
sin_alpha = sin(alpha)

#Villarceau #1, with a dependency on the angle "psi"
def villarceau(t, psi):
    x = R*cos_alpha*cos(t)
    y = R*sin(t) + r
    z = -R*sin_alpha*cos(t)
    rot_psi = Xform.rotation(axis = Vec(0,0,1), angle = -psi)
    pt_out = Point(x,y,z)*rot_psi
    return pt_out

#Set v to the angle used in derivation of 2 V-circles.  Choose one and let
#    u traverse pts on that circle
def torus(u,v):
    cos_gamma = -r*sin(v)/(R*sin_alpha)
    if (v > 0.5*pi) and (v < 1.5*pi):
        psi_v1 = atan2(-R*sqrt(1-cos_gamma*cos_gamma) + r, R*cos_alpha*cos_gamma)
    else:
        psi_v1 = atan2(R*sqrt(1-cos_gamma*cos_gamma) + r, R*cos_alpha*cos_gamma)
    return villarceau(u, psi_v1)

surf = Surface(torus, Interval.twopi(), Interval.twopi())
a.put(surf)
b.put(surf.surrogate)
# ---------- end decodes_4 ----------
mesh_3 = Mesh(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)

# ---- group: Family of 4 Circles
md_slider = MDSlider(
    slider_value=Point(0.5222377777, 0.1923036575, 0.5),
    SliderMode=0,
    x_domain=Domain(0, 6.283),
    y_domain=Domain(0, 6.283),
    z_domain=Domain(0, 1))
decodes_5 = DecodesPythonScript(r=minor_radius_2, R=major_radius_2, ipt=md_slider)  # -> console, a, circles
# ---------- decodes_5: Python ----------
"""
Draws the 4 circles -- parallel, meridian, Villarceau (2)
given a point on the torus 
"""
from math import *

u = ipt.x
v = ipt.y

"""
Calculation of Relevant Angles
"""
alpha = asin(r/R) #tilt angle for Villarceau circles
cos_alpha = cos(alpha)
sin_alpha = sin(alpha)
cos_gamma = -r*sin(v)/(R*sin_alpha)
if (v > 0.5*pi) and (v < 1.5*pi):
    psi_v1 = atan2(-R*sqrt(1-cos_gamma*cos_gamma) + r, R*cos_alpha*cos_gamma)
    psi_v2 = atan2(R*sqrt(1-cos_gamma*cos_gamma) - r, R*cos_alpha*cos_gamma)
else:
    psi_v1 = atan2(R*sqrt(1-cos_gamma*cos_gamma) + r, R*cos_alpha*cos_gamma)
    psi_v2 = atan2(-R*sqrt(1-cos_gamma*cos_gamma) - r, R*cos_alpha*cos_gamma)
    
rot_psi_v1 = Xform.rotation(axis = Vec(0,0,1), angle = -psi_v1)
rot_psi_v2 = Xform.rotation(axis = Vec(0,0,1), angle = -psi_v2)

"""
Parallel Circle
The parameter t acts as angle "theta"
"""
def func1(t):
    rho = R + r*cos(v)
    x = rho*cos(t)
    y = rho*sin(t)
    z = r*sin(v)
    pt_out = Point(x,y,z)
    return pt_out
   
"""
Meridian Circle
The parameter t acts as angle "phi"
"""   
def func2(t):
    x = R + r*cos(t)
    y = 0
    z = r*sin(t)
    pt_out = Point(x,y,z)
    return pt_out

"""
Villarceau Circle #1
The parameter t acts as angle "gamma"
""" 
def func_v1(t):
    x = R*cos_alpha*cos(t)
    y = R*sin(t) + r
    z = -R*sin_alpha*cos(t)
    pt_out = Point(x,y,z)*rot_psi_v1
    return pt_out

"""
Villarceau Circle #2
The parameter t acts as angle "gamma"
"""   
def func_v2(t):
    x = R*cos_alpha*cos(t)
    y = R*sin(t) - r
    z = -R*sin_alpha*cos(t)
    pt_out = Point(x,y,z)*rot_psi_v2
    return pt_out

"""
Rotation of circle 
"""
rot = Xform.rotation(axis = Vec(0,0,1), angle = u)
pt_out = func1(0)*rot
circ1 = Circle.thru_pts(func1(0), func1(0.5*pi), func1(pi))*rot
circ2 = Circle.thru_pts(func2(0), func2(0.5*pi), func2(pi))*rot
circ3 = Circle.thru_pts(func_v1(0), func_v1(0.5*pi), func_v1(pi))*rot
circ4 = Circle.thru_pts(func_v2(0), func_v2(0.5*pi), func_v2(pi))*rot

a.put(pt_out)
circles.put(circ1)
circles.put(circ2)
circles.put(circ3)
circles.put(circ4)
# ---------- end decodes_5 ----------

# ---- group: Basic Parametrization
decodes_6 = DecodesPythonScript(r=minor_radius_2, R=major_radius_2)  # -> console, a, b
# ---------- decodes_6: Python ----------
"""
Torus - standard parametrization as a surface of revolution 
    x = (R + r*cos(v))*cos(u)
    y = (R + r*cos(v))*sin(u)
    z = r*sin(v)
    domain = [0, 2*pi]x[0, 2*pi]
Will look primarily at the case of the ring torus when R > r > 0
    
"""

from math import *

def torus(u,v):
    x = (R + r*cos(v))*cos(u)
    y = (R + r*cos(v))*sin(u)
    z = r*sin(v)
    return Point(x,y,z)

surf = Surface(torus, Interval.twopi(), Interval.twopi())
a.put(surf)
b.put(surf.surrogate)
# ---------- end decodes_6 ----------
mesh_4 = Mesh(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)

# ----
mesh_5 = Mesh(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)
mesh_6 = Mesh(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)
decodes_7 = DecodesPythonScript()  # -> console, a, V_1, V_2; disabled
# ---------- decodes_7: Python ----------
"""
Alternative parametrizations for the ring torus with isocurves as combinations
of the family of four curves
"""

from math import *

alpha = asin(r/R)
cos_alpha = cos(alpha)
sin_alpha = sin(alpha)

#Villarceau #1  (t = "gamma")
def func_v1(t, psi):
    x1 = R*cos_alpha*cos(t)
    y1 = R*sin(t) + r
    z1 = -R*sin_alpha*cos(t)
    rot_psi = Xform.rotation(axis = Vec(0,0,1), angle = -psi)
    pt_out = Point(x1,y1,z1)*rot_psi
    return pt_out

#Villarceau #2  (t = "gamma")
def func_v2(t, psi):
    x = R*cos_alpha*cos(t)
    y = R*sin(t) - r
    z = -R*sin_alpha*cos(t)
    rot_psi = Xform.rotation(axis = Vec(0,0,1), angle = -psi)
    pt_out = Point(x,y,z)*rot_psi
    return pt_out

#Set v to phi which determines 2 V-circles.  Choose one and let
#    u traverse pts on that circle
def surf_func(u,v):
    phi = v
    cos_gamma = -r*sin(phi)/(R*sin_alpha)
    if (phi > 0.5*pi) and (phi < 1.5*pi):
        psi_v1 = atan2(-R*sqrt(1-cos_gamma*cos_gamma) + r, R*cos_alpha*cos_gamma)
    else:
        psi_v1 = math.atan2(R*(1-cos_gamma*cos_gamma) + r, R*cos_alpha*cos_gamma)
     
    return func_v1(u, psi_v1)


Alt = Surface(surf_func,Interval.twopi(),Interval.twopi())
Alt.tol_u=.25
Alt.tol_v=.25

def dupin(u,v):
    vec = Vec(ipt, surf_func(u,v))
    vec.length = 1/(vec.length*rad_i)
    return ipt + vec

def iso_pts(srf, param, res, dir="u") :
    pts=[]
    if dir == "u" : 
        for n in Interval().divide(res): pts.append(srf.deval(n, param))
        return PLine(pts)
    elif dir == "v" :
        for n in Interval().divide(res): pts.append(srf.deval(param, n))
        return PLine(pts)
    else : print "please set dir = to u or v"
    



srf = Surface(dupin,Interval.twopi(),Interval.pi())
srf.tol_u = .1
srf.tol_v = .2


ln1 = iso_pts(srf, v_1pos, 50, dir="u")
ln2 = iso_pts(srf, v_2pos, 50, dir="v")


a.put(srf.surrogate)

V_1.put(ln1)

V_2.put(ln2)
# ---------- end decodes_7 ----------

# ----
# c
slider = Slider(0.317, range=0..1)

# ----
# b
radius_of_inversion = Slider(1.81, range=0..2)
md_slider_2 = MDSlider(
    slider_value=Point(0.4503706025, 0.3416599181, 0.5),
    SliderMode=0,
    x_domain=Domain(0, 1),
    y_domain=Domain(0, 1),
    z_domain=Domain(0, 1))
pi = Pi(Factor=Slider(0.69, range=0..1))

# ---- group: dupin cylide surface
decodes_8 = DecodesPythonScript(
    torus=decodes_2.a,
    r_i=radius_of_inversion,
    origin=md_slider_2,
    sphere_invert=decodes_3.a,
    u_pos=Slider(0.108, range=0..1),
    v_pos=slider)  # -> console, a, b, c
# ---------- decodes_8: Python ----------
from math import *

def dupin(u,v):
   return sphere_invert(torus(u,v), origin, r_i) 

def iso_pts(srf, param, res, dir="u") :
    pts=[]
    if dir == "u" : 
        for n in Interval().divide(res): pts.append(srf.eval(n, param))
        return PLine(pts)
    elif dir == "v" :
        for n in Interval().divide(res): pts.append(srf.eval(param, n))
        return PLine(pts)
    else : print "please set dir = to u or v"
    

surf = Surface(dupin,Interval.twopi(),Interval.twopi())
#surf.tol_u = 0.2
#surf.tol_v = 0.2
a.put(surf.surrogate)

ln1 = iso_pts(surf, u_pos, 50, dir="v")
ln2 = iso_pts(surf, v_pos, 50, dir="u")


b.put(ln1)
c.put(ln2)
# ---------- end decodes_8 ----------

# ----
u_isocurve = Curve(decodes_8.b)
mesh_7 = Mesh(decodes_8.a)
v_isocurve = Curve(decodes_8.c)

# ---- group: demos invariance of angles
decodes_9 = DecodesPythonScript(circ_rad=Slider(0.14, range=0.01..1), angle=pi, r_i=radius_of_inversion, origin=md_slider_2, sphere_invert=decodes_3.a)  # -> console, a, b
# ---------- decodes_9: Python ----------
from math import *


def get_tangent(circle, pt):
    n_vec = circle._vec
    circ_center = circle.plane.origin
    return Vec(circ_center, pt).cross(n_vec)

#create two circles with a common hinge point to demonstrate invariance of angle
#note: circles not going through the origin invert to circles not through origin

max_rad = 3*r_i

r = max_rad*circ_rad

p1 = Point(-r,0,0)
p2 = Point(0,-r,0) #hinge point
p3 = Point(r,0,0)
circ_fixed = Circle.thru_pts(p1, p2, p3)

rot = Xform().rotation(center = Point(), axis = Vec(0,1,0), angle = angle)
p1_rot = p1*rot
p2_rot = p2*rot
p3_rot = p3*rot
circ_rot = Circle.thru_pts(p1_rot, p2_rot, p3_rot)

p1_i = sphere_invert(p1, origin, r_i)
p2_i = sphere_invert(p2, origin, r_i)
p3_i = sphere_invert(p3, origin, r_i)
circ_fixed_i = Circle.thru_pts(p1_i, p2_i, p3_i)

p1_rot_i = sphere_invert(p1_rot, origin, r_i)
p2_rot_i = sphere_invert(p2_rot, origin, r_i)
p3_rot_i = sphere_invert(p3_rot, origin, r_i)
circ_rot_i = Circle.thru_pts(p1_rot_i, p2_rot_i, p3_rot_i)

#check angle between tangents of inverted circles at hinge point
tan = get_tangent(circ_fixed_i, p2_i)
tan_rot = get_tangent(circ_rot_i, p2_rot_i)
angle_i = tan.angle(tan_rot)
print "Angle between circles at hinge is", degrees(angle)
print "Angle between invered circles is", degrees(angle_i)

a.put([circ_fixed, circ_rot, p2])
b.put([circ_fixed_i, circ_rot_i, p2_i])
# ---------- end decodes_9 ----------

# ---- group: inversion of pts and circles
decodes_10 = DecodesPythonScript(
    pt_rad=Slider(0.33, range=0.01..1),
    circ_rad=Slider(0.42, range=0.01..1),
    r_i=radius_of_inversion,
    origin=md_slider_2,
    sphere_invert=decodes_3.a)  # -> console, a, b
# ---------- decodes_10: Python ----------
from math import *

max_rad = 3*r_i
v = Vec(1,1,1).normalized()
#vectors perpendicular to v
v_perp_1 = Vec(-1,0,1).normalized()
v_perp_2 = Vec(1,-1,0).normalized()
v_perp_3 = Vec(0.5, 0.5, -1).normalized()

#inversion of a point
ln_pt = Segment(origin, v*max_rad)
pt = ln_pt.eval(pt_rad)
pt_i = sphere_invert(pt, origin, r_i)
print Vec(origin, pt).length*Vec(origin, pt_i).length, r_i**2


#inversion of a circle not going through origin
circ = Circle(Plane(pt, v), circ_rad*max_rad)
#find points on circle
pt1 = pt + v_perp_1*circ.rad
pt2 = pt + v_perp_2*circ.rad
pt3 = pt + v_perp_3*circ.rad
pt1_i = sphere_invert(pt1, origin, r_i)
pt2_i = sphere_invert(pt2, origin, r_i)
pt3_i = sphere_invert(pt3, origin, r_i)
circ_i = Circle.thru_pts(pt1_i, pt2_i, pt3_i)


a.put(pt)
b.put(pt_i)
a.put(circ)
b.put(circ_i)
# ---------- end decodes_10 ----------

# ----
center_of_inversion = Point(md_slider_2)

# ---- group: inversion sphere
sph = Sphere(Base=md_slider_2, Radius=radius_of_inversion)

# ----
inverted_circles = Geometry(decodes_9.b)
inverted_pt_circle = Geometry(decodes_10.b)
circles = Geometry(decodes_9.a)
pt_circle = Geometry(decodes_10.a)
panel = Panel(decodes_9.console)
